# Grasshopper definition example_camera_rotation.gh (Grasshopper 1.0.7)
# plug-ins: Heteroptera, Firefly.X, gHowl, Fologram For Grasshopper Utilities, Telepathy

# ---- group: Receive and Handle OSC Signals
panel = Panel("""click
fist
full_pinch
spreadfingers
swipe_down
swipe_left
swipe_right
swipe_up
tap
thumb_down
thumb_up
two_fingers_pinch_open
v_sign
wave""")
udp = UDPReceiver(Address="127.0.0.1", Port="7001", Pattern="999")  # -> Info, Data
python = GhPythonScript(osc=udp.Data, gesture_names=panel)  # -> out, raw_signals, state_grab, x_pos, y_pos, z_rot, x_rot; inputs osc: list, gesture_names: list
# ---------- python: Python ----------
import rhinoscriptsyntax as rs
import scriptcontext as rsc
import time
import math

raw_signals = []

millis = int(round(time.time() * 1000))

# Initialize persistent variables if necessary
if not 'initialized' in rsc.sticky:
    rsc.sticky['initialized'] = True
    rsc.sticky['state_grab'] = False
    rsc.sticky['x_array'] = [0,0,0]
    rsc.sticky['y_array'] = [0,0,0]
    rsc.sticky['last_x_pos'] = 0
    rsc.sticky['last_y_pos'] = 0
    rsc.sticky['array_pos'] = 0
    rsc.sticky['last_millis'] = 0
    rsc.sticky['x_rot'] = 0
    rsc.sticky['z_rot'] = 0
    rsc.sticky['sync_time'] = -1
    rsc.sticky['last_events'] = {}
    

# Transform OSC input data
osc_dict = {}

for i in range(0,len(osc),2):
    osc_dict[osc[i][1:]] = float(osc[i+1])
    

    
if 'millis' in osc_dict:
    if int(osc_dict['millis']) == 0:
        rsc.sticky['sync_time'] = millis

sync_time = rsc.sticky['sync_time']
        
        
    
# Handle x and y position
array_pos = rsc.sticky['array_pos']
if 'x_pos' in osc_dict:
    x = osc_dict['x_pos']
    rsc.sticky['x_array'][array_pos] = x
    
if 'y_pos' in osc_dict:
    y = osc_dict['y_pos']
    rsc.sticky['y_array'][array_pos] = y
    
rsc.sticky['array_pos'] = (array_pos + 1) % 3

x_pos = round(sum(rsc.sticky['x_array']) / 3,3)
y_pos = round(sum(rsc.sticky['y_array']) / 3,3)

last_events = rsc.sticky['last_events']
# Check all gestures
for name in gesture_names:
    last_firing = osc_dict[name]
    last_firing += sync_time
    last_event = last_events.get(name,None)
    if last_event is None or last_event < last_firing:
        raw_signals.append(True)
        last_events[name] = last_firing
        
        if name == 'fist':
            rsc.sticky['state_grab'] = True
        elif name == 'spreadfingers':
            rsc.sticky['state_grab'] = False
            
    else:
        raw_signals.append(False)
        

    
    
# Move camera

if rsc.sticky['state_grab']:
    x_diff = x_pos - rsc.sticky['last_x_pos']
    y_diff = y_pos - rsc.sticky['last_y_pos']
    
    x_rot_temp = rsc.sticky['x_rot']
    x_rot_temp = x_rot_temp + (y_diff / 100)
    x_rot_temp = max(-math.pi / 2, min(math.pi / 2,x_rot_temp))
    rsc.sticky['x_rot'] = x_rot_temp
    
    rsc.sticky['z_rot'] = rsc.sticky['z_rot'] + (x_diff / 100.0)
    

    
# Set outputs

state_grab = rsc.sticky['state_grab']
x_rot = round(rsc.sticky['x_rot'],3)
z_rot = round(rsc.sticky['z_rot'],3)

rsc.sticky['last_x_pos'] = x_pos
rsc.sticky['last_y_pos'] = y_pos

# Output printing

print (millis - rsc.sticky['last_millis'])
rsc.sticky['last_millis'] = millis

print(millis)
print(rsc.sticky['sync_time'])

#print(osc_dict.keys())
# ---------- end python ----------
panel_2 = Panel(python.raw_signals)
panel_3 = Panel(python.state_grab)

# ----
# To respond to a single gesture, put its id number from the list above into the list item component.
# The Bang T output will be momentarily true, you can use that directly or control a gate etc.
panel_4 = Panel("0")
item = ListItem(List=python.raw_signals, Index=panel_4, Wrap=True)
bang = Bang(BooleanInput=item)  # -> TrueState, FalseState
data = Data()
gate = StreamGate(Stream=data, Gate=bang.TrueState)  # -> Target0, Target1
data_2 = Data(gate.Target1)

# ---- group: Reset scriptcontext.sticky
python_2 = GhPythonScript(x=Button())  # -> out, a
# ---------- python_2: Python ----------
import scriptcontext as rsc

if x:
    rsc.sticky = {}
# ---------- end python_2 ----------

# ---- group: Preview Box
number_slider = Slider(10, range=0..10)
box = CenterBox(Base=PlaneXY(0, 0, 0), X=number_slider, Y=number_slider, Z=number_slider)
preview = CustomPreview(Geometry=box, Material="100,100,200")

# ----
boolean_command_add = RemoteSender(bang.TrueState)
edges = BrepEdges(Brep=box)  # -> Naked, Interior, NonManifold
panel_5 = Panel(python.x_rot)
panel_6 = Panel(python.z_rot)
mpipe = MeshPipe(Polylines=edges.Interior, NumberOfSides=4, Tolerance=0.1, Radius="0.15", Cap=False, Join=False)

# ---- group: Normalizing Hand Positoin
domain_x_input = Domain("500 to 100")
domain_y_input = Domain("400 to 150")
remap = RemapNumbers(Value=python.x_pos, Source=domain_x_input, Target=Domain(0, 1))  # -> Mapped, Clipped
remap_2 = RemapNumbers(Value=python.y_pos, Source=domain_y_input, Target=Domain(0, 1))  # -> Mapped, Clipped
pt = ConstructPoint(XCoordinate=remap.Mapped, YCoordinate=remap_2.Mapped, ZCoordinate=0)
panel_7 = Panel(pt)

# ---- group: Move Camera
xz = XZPlane(Origin=Point(0, 0, 0))
rotate = Rotate(Geometry="150,0,20", Angle=python.x_rot, Plane=xz)  # -> Geometry, Transform
rotate_2 = Rotate(Geometry=rotate.Geometry, Angle=python.z_rot, Plane=PlaneXY(0, 0, 0))  # -> Geometry, Transform
camera = CameraCrane(Location=rotate_2.Geometry, Target="0,0,0", Refresh=True)  # -> Camera, Target, Lens, Up, HorizontalViewAngle, VerticalViewAngle, ScreenRatio, Frame

# ----
preview_2 = CustomPreview(Geometry=mpipe, Material="0,0,0")
