# Grasshopper definition example_camera_sculpting.gh (Grasshopper 1.0.7)
# plug-ins: Heteroptera, Pufferfish, Firefly.X, Parakeet, gHowl, Fologram For Grasshopper Utilities, Millipede, Weaverbird, Telepathy

# ---- group: Toggle Streaming Input
add_delete = BooleanToggle(True)
# Required Plugins :
# - Firefly (OSC Listener)
# - Fologram (Toggling Network Connection)
# - GHowl (UDP Communication)
# - Heteroptera (Stream Smoothing)
# - Telepathy (Wireless Connections)
# 
# Using HyperIMU for Android
# - AKM09912 Orientation
# - Linear Acceleration
# 
# Using TouchOSC for Android
# cyan components require local settings
# e.g. ip address, file path etc.
# magenta groups handle input from outside grasshopper
use_mouse = BooleanToggle(False)
streaming = BooleanToggle(False)
boolean_use_mouse = RemoteSender(use_mouse)
T = StateGate(States=streaming)  # -> True, False

# ---- group: Reset scriptcontext.sticky
python = GhPythonScript(x=Button())  # -> out, a
# ---------- python: Python ----------
import scriptcontext as rsc

if x:
    rsc.sticky = {}
# ---------- end python ----------

# ----
c_rec_ctrl = CSharpScript()  # -> out, pause_state; inputs clean: Boolean, pause: Boolean
# ---------- c_rec_ctrl: C# usings ----------
using System.IO;
using System.Linq;
using System.Data;
using System.Drawing;
using System.Reflection;
using System.Windows.Forms;
using System.Xml;
using System.Xml.Linq;
using System.Runtime.InteropServices;

using Rhino.DocObjects;
using Rhino.Collections;
using GH_IO;
using GH_IO.Serialization;
# ---------- c_rec_ctrl: C# ----------
    //iterate through all the objects of the grashopper document;
    foreach (object obj in GrasshopperDocument.Objects) {
      //check only for the GH_DataRecorder components
      if (obj is Grasshopper.Kernel.Special.GH_DataRecorder) {
        //cast the obj into GH_DataRecorder wrapper class to be able to access its methods
        Grasshopper.Kernel.Special.GH_DataRecorder dataDestroy = (Grasshopper.Kernel.Special.GH_DataRecorder) obj;

        if (dataDestroy.NickName == "Rec : Points") {
          //store the recording state of the component in a temp boolean
          bool recState = dataDestroy.RecordData;

          if(clean) {
            //clean the data and reset the recorder component
            dataDestroy.DestroyRecordedData();
            dataDestroy.ExpireSolution(true);
          }
          if(pause) {
            dataDestroy.RecordData = !recState;
            recState = dataDestroy.RecordData;
          }
          pause_state = recState;
        }
       
      }
    }
# ---------- end c_rec_ctrl ----------
rec_points = DataRecorder(DataLimit=-10, RecordData=True)

# ---- group: Receive and Handle OSC Signals
panel = Panel("""click
fist
full_pinch
spreadfingers
swipe_down
swipe_left
swipe_right
swipe_up
tap
thumb_down
thumb_up
two_fingers_pinch_open
v_sign
wave""")
udp = UDPReceiver(Address="127.0.0.1", Port="7001", Pattern="999")  # -> Info, Data
python_2 = GhPythonScript(osc=udp.Data, gesture_names=panel)  # -> out, raw_signals, state_grab, state_add, x_pos, y_pos, z_rot, x_rot; inputs osc: list, gesture_names: list
# ---------- python_2: Python ----------
import rhinoscriptsyntax as rs
import scriptcontext as rsc
import time
import math

raw_signals = []

millis = int(round(time.time() * 1000))

# Initialize persistent variables if necessary
if not 'initialized' in rsc.sticky:
    rsc.sticky['initialized'] = True
    rsc.sticky['state_grab'] = False
    rsc.sticky['x_array'] = [0,0,0]
    rsc.sticky['y_array'] = [0,0,0]
    rsc.sticky['last_x_pos'] = 0
    rsc.sticky['last_y_pos'] = 0
    rsc.sticky['array_pos'] = 0
    rsc.sticky['last_millis'] = 0
    rsc.sticky['x_rot'] = 0
    rsc.sticky['z_rot'] = 0
    rsc.sticky['sync_time'] = -1
    rsc.sticky['state_add'] = False
    rsc.sticky['last_events'] = {}
    

# Transform OSC input data
osc_dict = {}

for i in range(0,len(osc),2):
    osc_dict[osc[i][1:]] = float(osc[i+1])
    

    
if 'millis' in osc_dict:
    if int(osc_dict['millis']) == 0:
        rsc.sticky['sync_time'] = millis

sync_time = rsc.sticky['sync_time']
        
        
    
# Handle x and y position
array_pos = rsc.sticky['array_pos']
if 'x_pos' in osc_dict:
    x = osc_dict['x_pos']
    rsc.sticky['x_array'][array_pos] = x
    
if 'y_pos' in osc_dict:
    y = osc_dict['y_pos']
    rsc.sticky['y_array'][array_pos] = y
    
rsc.sticky['array_pos'] = (array_pos + 1) % 3

x_pos = round(sum(rsc.sticky['x_array']) / 3,3)
y_pos = round(sum(rsc.sticky['y_array']) / 3,3)

last_events = rsc.sticky['last_events']
# Check all gestures
for name in gesture_names:
    last_firing = osc_dict[name]
    last_firing += sync_time
    last_event = last_events.get(name,None)
    if last_event is None or last_event < last_firing:
        raw_signals.append(True)
        last_events[name] = last_firing
        
        if name == 'fist':
            rsc.sticky['state_grab'] = True
        elif name == 'spreadfingers':
            rsc.sticky['state_grab'] = False
        elif name == 'tap':
            rsc.sticky['state_add'] = not rsc.sticky['state_add']
            
    else:
        raw_signals.append(False)
        

    
    
# Move camera

if rsc.sticky['state_grab']:
    x_diff = x_pos - rsc.sticky['last_x_pos']
    y_diff = y_pos - rsc.sticky['last_y_pos']
    
    x_rot_temp = rsc.sticky['x_rot']
    x_rot_temp = x_rot_temp + (y_diff / 100)
    x_rot_temp = max(-math.pi / 2, min(math.pi / 2,x_rot_temp))
    rsc.sticky['x_rot'] = x_rot_temp
    
    rsc.sticky['z_rot'] = rsc.sticky['z_rot'] + (x_diff / 100.0)
    

    
# Set outputs

state_grab = rsc.sticky['state_grab']
state_add = rsc.sticky['state_add']
x_rot = round(rsc.sticky['x_rot'],3)
z_rot = round(rsc.sticky['z_rot'],3)

rsc.sticky['last_x_pos'] = x_pos
rsc.sticky['last_y_pos'] = y_pos

# Output printing

print (millis - rsc.sticky['last_millis'])
rsc.sticky['last_millis'] = millis

print(millis)
print(rsc.sticky['sync_time'])

#print(osc_dict.keys())
# ---------- end python_2 ----------
panel_2 = Panel(python_2.raw_signals)
panel_3 = Panel(python_2.state_grab)

# ----
# To respond to a single gesture, put its id number from the list above into the list item component.
# The Bang T output will be momentarily true, you can use that directly or control a gate etc.
item = ListItem(List=python_2.raw_signals, Index="0", Wrap=True)
bang = Bang(BooleanInput=item)  # -> TrueState, FalseState

item_2 = ListItem(List=python_2.raw_signals, Index="13", Wrap=True)
bang_2 = Bang(BooleanInput=item_2)  # -> TrueState, FalseState
boolean_command_clear = RemoteSender(bang_2.TrueState)

panel_4 = Panel(python_2.x_rot)
panel_5 = Panel(python_2.z_rot)
panel_6 = Panel(python_2.state_add)
boolean_add_delete = RemoteSender(python_2.state_add)

boolean_add_delete_2 = RemoteReceiver(boolean_add_delete)
gate = StreamGate(Stream=bang.TrueState, Gate=boolean_add_delete_2)  # -> Target0, Target1
boolean_command_delete = RemoteSender(gate.Target0)
boolean_command_add = RemoteSender(gate.Target1)

# ---- group: Normalizing Hand Positoin
domain_x_input = Domain("500 to 100")
domain_y_input = Domain("400 to 150")
remap = RemapNumbers(Value=python_2.x_pos, Source=domain_x_input, Target=Domain(0, 1))  # -> Mapped, Clipped
remap_2 = RemapNumbers(Value=python_2.y_pos, Source=domain_y_input, Target=Domain(0, 1))  # -> Mapped, Clipped
pt = ConstructPoint(XCoordinate=remap.Mapped, YCoordinate=remap_2.Mapped, ZCoordinate=0)

# ---- group: Move Camera
xz = XZPlane(Origin=Point(0, 0, 0))
rotate = Rotate(Geometry="150,0,20", Angle=python_2.x_rot, Plane=xz)  # -> Geometry, Transform
rotate_2 = Rotate(Geometry=rotate.Geometry, Angle=python_2.z_rot, Plane=PlaneXY(0, 0, 0))  # -> Geometry, Transform
camera = CameraCrane(Location=rotate_2.Geometry, Target="0,0,0", UPVector="0,0,1", Refresh=True)  # -> Camera, Target, Lens, Up, HorizontalViewAngle, VerticalViewAngle, ScreenRatio, Frame
point_camera_location = RemoteSender(rotate_2.Geometry)
srf = Surface(camera.Frame)
evalsrf = EvaluateSurface(Surface=reparameterize(srf), Point=pt)  # -> Point, Normal, UDirection, VDirection, Frame
ln = Line(StartPoint=rotate_2.Geometry, EndPoint=evalsrf.Point)
scale = Scale(Geometry=ln, Center=rotate_2.Geometry, Factor="10")  # -> Geometry, Transform
line_camera_ray = RemoteSender(scale.Geometry)

# ---- group: Create Ray From Mouse
boolean_use_mouse_2 = RemoteReceiver(boolean_use_mouse)
boolean_add_delete_3 = RemoteReceiver(boolean_add_delete)
mouse = Mouse(Triger=boolean_use_mouse_2)  # -> CursorPosition, LeftMouseButton, MiddleMouseButton, RightMouseButton
bang_3 = Bang(BooleanInput=mouse.LeftMouseButton)  # -> TrueState, FalseState
txt = Text(mouse.CursorPosition)
point_camera_location_2 = RemoteReceiver(point_camera_location)
eventswitch = EventGate(Data=txt)  # -> Data, IsNew
gate_2 = StreamGate(Stream=bang_3.TrueState, Gate=boolean_add_delete_3)  # -> Target0, Target1
freeze_gate = StreamFreezeGate(Data=mouse.CursorPosition, PassingSwitch=eventswitch.IsNew, Freeze=True)
boolean_command_delete_2 = RemoteSender(gate_2.Target0)  # disabled
boolean_command_add_2 = RemoteSender(gate_2.Target1)  # disabled
ln_2 = Line(StartPoint=point_camera_location_2, EndPoint=freeze_gate)
scale_2 = Scale(Geometry=ln_2, Center=point_camera_location_2, Factor="10")  # -> Geometry, Transform
line_mouse_ray = RemoteSender(scale_2.Geometry)

# ----
pt_2 = Point(evalsrf.Point)

# ---- group: Create Grid and Collide Against Ray
num_cell_size = Number("5")
num_grid_size = Number("10")
series = Series(Start=0, Step=num_cell_size, Count=num_grid_size)
expression = Expression(x=num_cell_size, y=num_grid_size, Expression="-(x * y) / 2")
num_grid_size_2 = RemoteSender(num_grid_size)
crossref = CrossReference(ListA=series, ListB=series, ListC=series, CrossMode=1)  # -> ListA, ListB, ListC
division = Division(A=num_cell_size, B="2")
pt_3 = ConstructPoint(XCoordinate=crossref.ListA, YCoordinate=crossref.ListB, ZCoordinate=crossref.ListC)
vec = VectorXYZ(XComponent=expression, YComponent=expression, ZComponent=expression)  # -> Vector, Length
move = Move(Geometry=flatten(pt_3), Motion=vec.Vector)  # -> simplify(Geometry), Transform
bbox = BoundingBox(Content=flatten(move.Geometry), Plane=PlaneXY(0, 0, 0), UnionBox=True)  # -> Box, Box_2
item_3 = ListItem(List=flatten(move.Geometry), Index="355", Wrap=True)
edges = BrepEdges(Brep=bbox.Box)  # -> Naked, Interior, NonManifold
box_bounding_box = RemoteSender(bbox.Box)
point_initial_point = RemoteSender(item_3)
point_point_grid = RemoteSender(move.Geometry)

# ----
mpipe = MeshPipe(Polylines=edges.Interior, NumberOfSides=4, Tolerance=0.1, Radius="0.1", Cap="1", Join=False)
preview = CustomPreview(Geometry=mpipe, Material="200,100,100")
boolean_use_mouse_3 = RemoteReceiver(boolean_use_mouse)
line_camera_ray_2 = RemoteReceiver(line_camera_ray)
line_mouse_ray_2 = RemoteReceiver(line_mouse_ray)
filter = StreamFilter(Gate=boolean_use_mouse_3, Stream0=line_camera_ray_2, Stream1=line_mouse_ray_2)
point_point_grid_2 = RemoteReceiver(point_point_grid)

# ---- group: Handle Voxels and Visualize
boolean_command_delete_3 = RemoteReceiver([boolean_command_delete_2, boolean_command_delete])
boolean_command_clear_2 = RemoteReceiver(boolean_command_clear)
boolean_command_add_3 = RemoteReceiver([boolean_command_add_2, boolean_command_add])
point_camera_location_3 = RemoteReceiver(point_camera_location)
boolean_add_delete_4 = RemoteReceiver(boolean_add_delete)
point_initial_point_2 = RemoteReceiver(point_initial_point)
python_3 = GhPythonScript(
    reset=boolean_command_clear_2,
    initial=point_initial_point_2,
    camera_location=point_camera_location_3,
    ray=filter,
    grid_points=point_point_grid_2,
    add=boolean_command_add_3,
    remove=boolean_command_delete_3,
    mouse_state=boolean_add_delete_4)  # -> out, a, b; inputs reset: Boolean, initial: Point3d, camera_location: Point3d, ray: Curve, grid_points: list of Point3d, add: Boolean, mouse_state: Boolean
# ---------- python_3: Python ----------
__author__ = "matt"
__version__ = "2020.05.14"

import rhinoscriptsyntax as rs
import scriptcontext as sc
import ghpythonlib.components as gh

# === DEFINITIONS ===
                
def scan_remove(test_distance = 0.05):
    for point in points:
        for existing in sc.sticky["data"]:
            if existing == None:
                continue
            if gh.Distance(point,existing) < test_distance:
                return(existing)
                
def scan_add(test_distance = 5.05):
    for point in points:
        for existing in sc.sticky["data"]:
            if existing == None:
                continue
            if gh.Distance(point,existing) < test_distance:
                return(point)




# === MAIN SCRIPT ===

# Reinitialize if necessary
if not 'data' in sc.sticky:
    sc.sticky["data"] = [initial]
    
closest_points = gh.CurveClosestPoint(grid_points,ray)[0]
x1_l,y1_l,z1_l = gh.Deconstruct(grid_points)
x2_l,y2_l,z2_l= gh.Deconstruct(closest_points)

# Find list of points representing voxels intersected by thre ray
good_points = []
for x1,y1,z1,x2,y2,z2 in zip(x1_l,y1_l,z1_l,x2_l,y2_l,z2_l):
    if (abs(x1-x2) < 2.5) and (abs(y1-y2)< 2.5) and (abs(z1-z2) < 2.5):
        good_points.append(True)
    else:
        good_points.append(False)

# Seperate and sort those points
points = gh.Dispatch(grid_points,good_points)[0]
points_distances = gh.Distance(camera_location,points)
points = gh.SortList(points_distances,points)[1]

if points is None:
    points = []


    

if add:
    point = scan_add()
    if point is not None:
        sc.sticky["data"].append(point)
    
elif remove:
    point = scan_remove()
    sc.sticky["data"].remove(point)
    
elif reset:
    sc.sticky["data"] = [initial]
    
else:
    if mouse_state:
        b = scan_add()
    else:
        b = scan_remove()
    
a = sc.sticky["data"]
# ---------- end python_3 ----------
box = CenterBox(Base=python_3.b, X=expr("x * 1.05", division), Y=expr("x * 1.05", division), Z=expr("x * 1.05", division))  # -> simplify(Box)
cullpt = CullDuplicates(Points=python_3.a, Tolerance=0.1, CullMode=3)  # -> Points, Indices, Valence
pt_4 = Point(cullpt.Points)
colour = ColourPicker(PickedColour=RGB(138, 90, 67))
box_2 = CenterBox(Base=pt_4, X=division, Y=division, Z=division)  # -> simplify(Box)
material = CreateMaterial(Diffuse=colour, Specular=RGB(255, 255, 255), Emission=RGB(0, 0, 0), Transparency=0, Shine=0)
preview_2 = CustomPreview(Geometry=box_2, Material=material)  # disabled

# ----
panel_7 = Panel(python_3.out)

point_point_grid_3 = RemoteReceiver(point_point_grid)
mindex = MemberIndex(Set=flatten(point_point_grid_3), Member=pt_4)  # -> simplify(Index), Count
lng = ListLength(List=flatten(point_point_grid_3))
repeat = RepeatData(Data="0", Length=lng)
replace = ReplaceItems(List=repeat, Item="1", Indices=flatten(mindex.Index), Wrap=False)
iso = Slider(0.5, range=-2..2)
box_bounding_box_2 = RemoteReceiver(box_bounding_box)
num_grid_size_3 = RemoteReceiver(num_grid_size_2)
iso_surface = IsoSurface(
    Box=box_bounding_box_2,
    Values=replace,
    XResolution=num_grid_size_3,
    YResolution=num_grid_size_3,
    ZResolution=num_grid_size_3,
    IsoValue=iso,
    MergeVertices=Toggle(True))
clsmsh = CloseMesh(Mesh=iso_surface, Quadrangulate=True)  # -> Closed, R
wbcatmullclark = WeaverbirdsCatmullClarkSubdivision(MeshCurves=clsmsh.Closed, Level=1, SmoothNakedEdges=1)
preview_3 = CustomPreview(Geometry=wbcatmullclark, Shader=ColourSwatch(SwatchColor=RGB(245, 114, 27)))
