# Grasshopper definition example_phone_imu.gh (Grasshopper 1.0.7)
# plug-ins: Heteroptera, Firefly.X, gHowl, Telepathy

# ----
# Required Plugins :
# - Firefly (OSC Listener)
# - GHowl (UDP Communication)
# - Heteroptera (Stream Smoothing)
# - Telepathy (Wireless Connections)
# 
# Tested with HyperIMU for Android
# - AKM09912 Orientation
# - Linear Acceleration
panel = Panel("192.168.1.54")
panel_2 = Panel("999")
udp = UDPReceiver(Address=panel, Port="6002", Pattern=0)  # -> Info, Data
dam = DataDam(DataA=udp.Data, BufferDelay=10000000, BufferMode=1)
split = TextSplit(Text=dam, Separators=",")
item = ListItem(List=split, Index=0, Wrap=True)  # -> Item, Item1, Item2, Item3, Item4, Item5
trim = TextTrim(Text=item.Item5, Start=True, End=True)
vec = VectorXYZ(XComponent=item.Item, YComponent=item.Item1, ZComponent=item.Item2)  # -> Vector, Length
vec_2 = VectorXYZ(XComponent=item.Item3, YComponent=item.Item4, ZComponent=trim)  # -> Vector, Length
vec_phone_acceleration = RemoteSender(vec_2.Vector)
vec_phone_orientation = RemoteSender(vec.Vector)

# ---- group: Touch-Osc Listener
timer = Timer(TimerInterval=20, Target=osc_listener)  # disabled
osc_listener = OSCListener(Port="8000", Reset=Button())

# ----
panel_3 = Panel("20")  # disabled

vec_phone_orientation_2 = RemoteReceiver(vec_phone_orientation)
devec = DeconstructVector(Vector=vec_phone_orientation_2)  # -> XComponent, YComponent, ZComponent
capacitor = Capacitor(Data=devec.XComponent, Capacity="3")
capacitor_2 = Capacitor(Data=devec.YComponent, Capacity="3")
capacitor_3 = Capacitor(Data=devec.ZComponent, Capacity="3")
num = Number(capacitor_2)
num_2 = Number(capacitor_3)
num_3 = Number(capacitor)
avr = Average(Input=num_3)
avr_2 = Average(Input=num)
avr_3 = Average(Input=num_2)
panel_4 = Panel(avr)
num_orientation_a = RemoteSender(avr)
num_orientation_b = RemoteSender(avr_2)
num_orientation_c = RemoteSender(avr_3)

panel_5 = Panel("10")  # disabled

box = CenterBox(Base=PlaneXY(0, 0, 0), X="4", Y="9", Z="1")

# ---- group: Apply Phone Orientation to Object
num_orientation_a_2 = RemoteReceiver(num_orientation_a)
brep = Brep(box)
addition = Addition(A=num_orientation_a_2, B=Slider(120, range=-180..180))
rad = Radians(Degrees=addition)
xy = XYPlane(Origin=Point(0, 0, 0))
num_orientation_b_2 = RemoteReceiver(num_orientation_b)
neg = Negative(Value=rad)
rotate = Rotate(Geometry=brep, Angle=neg, Plane=xy)  # -> Geometry, Transform
yz = YZPlane(Origin=Point(0, 0, 0))
transform = Transform(Geometry=yz, Transform=rotate.Transform)
rad_2 = Radians(Degrees=num_orientation_b_2)
neg_2 = Negative(Value=rad_2)
rotate_2 = Rotate(Geometry=rotate.Geometry, Angle=neg_2, Plane=transform)  # -> Geometry, Transform
num_orientation_c_2 = RemoteReceiver(num_orientation_c)
merge = Merge(Data1=rotate.Transform, Data2=rotate_2.Transform)
xz = XZPlane(Origin=Point(0, 0, 0))
comp = Compound(Transforms=merge)
rad_3 = Radians(Degrees=num_orientation_c_2)
transform_2 = Transform(Geometry=xz, Transform=comp)
rotate_3 = Rotate(Geometry=rotate_2.Geometry, Angle=rad_3, Plane=transform_2)  # -> Geometry, Transform
merge_2 = Merge(Data1=comp, Data2=rotate_3.Transform)
comp_2 = Compound(Transforms=merge_2)
transform_3 = Transform(comp_2)
brep_2 = Brep(rotate_3.Geometry)
transform_orientation = RemoteSender(transform_3)

# ----
transform_orientation_2 = RemoteReceiver(transform_orientation)  # disabled

material = CreateMaterial(Diffuse="50,50,50", Specular=RGB(255, 255, 255), Emission=RGB(0, 0, 0), Transparency=0, Shine=0)
preview = CustomPreview(Geometry=brep_2, Material=material)

# ---- group: Create Spheres
box_2 = CenterBox(Base="0,100,0", X="50", Y="50", Z="50")
random = Random(Range="10 to 20", Number="10", Seed=2)
pop3d = Populate3D(Region=box_2, Count="10", Seed=1)
sph = Sphere(Base=pop3d, Radius=random)
brep_3 = Brep(sph)

# ---- group: Adjust Rhino Camera
Z = UnitZ(Factor=1)
transform_4 = Transform(Geometry="0,-50,5", Transform=transform_3)
transform_5 = Transform(Geometry=Z, Transform=transform_3)
capacitor_4 = Capacitor(Data=transform_4, Capacity="3")
capacitor_5 = Capacitor(Data=transform_5, Capacity="3")
avr_4 = Average(Input=capacitor_4)
avr_5 = Average(Input=capacitor_5)
camera = CameraCrane(Location=avr_4, Target="0,0,0", UPVector=avr_5, Refresh=True)  # -> Camera, Target, Lens, Up, HorizontalViewAngle, VerticalViewAngle, ScreenRatio, Frame

# ---- group: Create Ray
transform_6 = Transform(Geometry="0,500,0", Transform=transform_3)
ln = Line(StartPoint="0,0,0", EndPoint=transform_6)

# ---- group: Select and Colorize Breps
brep_4 = Brep(brep_3)
line = Line(ln)
blx = BrepLine(Brep=brep_4, Line=line, LimitToFirst=False)  # -> Curves, simplify(Points)
lng = ListLength(List=blx.Points)
larger = LargerThan(FirstNumber=lng, SecondNumber="0")  # -> flatten(LargerThan), OrEqualTo
p_n_c = PickNChoose(Pattern=graft(larger.LargerThan), Stream0="0,0,255", Stream1="0,255,255")  # -> flatten(Result)
preview_2 = CustomPreview(Geometry=brep_4, Material=p_n_c)

# ----
# Use with HyperIMU BMI160 3-axis accelerometer
vec_phone_acceleration_2 = RemoteReceiver(vec_phone_acceleration)  # disabled
panel_6 = Panel("3")  # disabled
capacitor_6 = Capacitor(Data=vec_phone_acceleration_2, Capacity=panel_6)  # disabled
avr_6 = Average(Input=capacitor_6)  # disabled
button = Button()  # disabled
panel_7 = Panel("0,0,0")  # disabled

capacitor_7 = Capacitor(Data=vec_phone_acceleration_2, Capacity=panel_3)  # disabled
devec_2 = DeconstructVector(Vector=capacitor_7)  # -> XComponent, YComponent, ZComponent; disabled
merge_3 = Merge(Data1=graft(devec_2.XComponent), Data2=graft(devec_2.YComponent), Data3=graft(devec_2.ZComponent))  # disabled
flip = FlipMatrix(Data=merge_3)  # disabled
transform_7 = Transform(Geometry=avr_6, Transform=transform_orientation_2)  # disabled
python = GhPythonScript(x=transform_7)  # -> simplify(a); inputs x: Vector3d; disabled
# ---------- python: Python ----------
__author__ = "matt"
__version__ = "2020.05.05"

import rhinoscriptsyntax as rs
import ghpythonlib.components as gh

if gh.VectorLength(x) < 0.3:
    a = gh.VectorXYZ(0,0,0)
else:
    a = x
# ---------- end python ----------
graph = QuickGraph(flip, SortOrder=0)  # disabled
item_2 = ListItem(List=python, Index=0, Wrap=True)  # disabled
panel_8 = Panel(item_2)  # disabled
vlen = VectorLength(Vector=item_2)  # disabled
multiplication = Multiplication(A=item_2, B=panel_5)  # disabled

vbma = MassAdditiveVectorsBuffer(Reset=button, Vectors=item_2)  # disabled
vbma_2 = MassAdditiveVectorsBuffer(Reset=button, Vectors=vbma)  # disabled
vdis = VectorDisplay(Anchor=panel_7, Vector=multiplication)  # disabled
pt = Point(vbma_2)  # disabled

panel_9 = Panel(vlen)  # disabled
