# Grasshopper definition fluxsight_demo.gh (Grasshopper 1.0.7)
# plug-ins: Heteroptera, Volvox, Human UI, Pufferfish, Firefly.X, AviaryMacawGH, Anemone, PCPA_GH, Human, Parakeet, MacawGH, gHowl, Fologram For Grasshopper Utilities, Moonlight, LunchBox, Weaverbird, MetaHopper, ProvingGround.Slingshot, Starling, Kangaroo2 Components, Pancake, Mesh Pipe, Wombat, Sunflower, TT Toolbox, Telepathy, ParrotGH, Yellow, Firefly.Core, Owl.GH

# ---- group: Receive and Handle OSC Signals
panel = Panel("""click
fist
full_pinch
spreadfingers
swipe_down
swipe_left
swipe_right
swipe_up
tap
thumb_down
thumb_up
two_fingers_pinch_open
v_sign
wave""")
udp = UDPReceiver(Address="127.0.0.1", Port="7001", Pattern="999")  # -> Info, Data
python = GhPythonScript(osc=udp.Data, gesture_names=panel)  # -> out, raw_signals, state_grab, state_add, x_pos, y_pos, z_rot, x_rot; inputs osc: list, gesture_names: list
# ---------- python: Python ----------
import rhinoscriptsyntax as rs
import scriptcontext as rsc
import time
import math

raw_signals = []

millis = int(round(time.time() * 1000))

# Initialize persistent variables if necessary
if not 'initialized' in rsc.sticky:
    rsc.sticky['initialized'] = True
    rsc.sticky['state_grab'] = False
    rsc.sticky['x_array'] = [0,0,0]
    rsc.sticky['y_array'] = [0,0,0]
    rsc.sticky['last_x_pos'] = 0
    rsc.sticky['last_y_pos'] = 0
    rsc.sticky['array_pos'] = 0
    rsc.sticky['last_millis'] = 0
    rsc.sticky['x_rot'] = 0
    rsc.sticky['z_rot'] = 0
    rsc.sticky['sync_time'] = -1
    rsc.sticky['state_add'] = False
    rsc.sticky['last_events'] = {}
    

# Transform OSC input data
osc_dict = {}

for i in range(0,len(osc),2):
    osc_dict[osc[i][1:]] = float(osc[i+1])
    

    
if 'millis' in osc_dict:
    if int(osc_dict['millis']) == 0:
        rsc.sticky['sync_time'] = millis

sync_time = rsc.sticky['sync_time']
        
        
    
# Handle x and y position
array_pos = rsc.sticky['array_pos']
if 'x_pos' in osc_dict:
    x = osc_dict['x_pos']
    rsc.sticky['x_array'][array_pos] = x
    
if 'y_pos' in osc_dict:
    y = osc_dict['y_pos']
    rsc.sticky['y_array'][array_pos] = y
    
rsc.sticky['array_pos'] = (array_pos + 1) % 3

x_pos = round(sum(rsc.sticky['x_array']) / 3,3)
y_pos = round(sum(rsc.sticky['y_array']) / 3,3)

last_events = rsc.sticky['last_events']
# Check all gestures
for name in gesture_names:
    last_firing = osc_dict[name]
    last_firing += sync_time
    last_event = last_events.get(name,None)
    if last_event is None or last_event < last_firing:
        raw_signals.append(True)
        last_events[name] = last_firing
        
        if name == 'fist':
            rsc.sticky['state_grab'] = True
        elif name == 'spreadfingers':
            rsc.sticky['state_grab'] = False
        elif name == 'tap':
            rsc.sticky['state_add'] = not rsc.sticky['state_add']
            
    else:
        raw_signals.append(False)
        

    
    
# Move camera

if rsc.sticky['state_grab']:
    x_diff = x_pos - rsc.sticky['last_x_pos']
    y_diff = y_pos - rsc.sticky['last_y_pos']
    
    x_rot_temp = rsc.sticky['x_rot']
    x_rot_temp = x_rot_temp + (y_diff / 100)
    x_rot_temp = max(-math.pi / 2, min(math.pi / 2,x_rot_temp))
    rsc.sticky['x_rot'] = x_rot_temp
    
    rsc.sticky['z_rot'] = rsc.sticky['z_rot'] + (x_diff / 100.0)
    

    
# Set outputs

state_grab = rsc.sticky['state_grab']
state_add = rsc.sticky['state_add']
x_rot = round(rsc.sticky['x_rot'],3)
z_rot = round(rsc.sticky['z_rot'],3)

rsc.sticky['last_x_pos'] = x_pos
rsc.sticky['last_y_pos'] = y_pos

# Output printing

print (millis - rsc.sticky['last_millis'])
rsc.sticky['last_millis'] = millis

print(millis)
print(rsc.sticky['sync_time'])

#print(osc_dict.keys())
# ---------- end python ----------
panel_2 = Panel(python.raw_signals)
panel_3 = Panel(python.state_grab)

# ----
# Gesture Control
panel_4 = Panel(python.x_rot)
panel_5 = Panel(python.z_rot)
panel_6 = Panel(python.state_add)
boolean_add_delete = RemoteSender(python.state_add)

# ---- group: Toggle Streaming Input
toggle = BooleanToggle(False)  # disabled
T = StateGate(States=toggle, LinkTarget=udp_2)  # -> True, False; disabled

# ---- group: Receive IMU Data From Phone Over UDP
# the final item has trailing whitespace
panel_7 = Panel("192.168.1.120")  # disabled
panel_8 = Panel("2055")  # disabled
udp_2 = UDPReceiver(Address=panel_7, Port=panel_8, Pattern=0)  # -> Info, Data; disabled
dam = DataDam(DataA=udp_2.Data, BufferDelay=10000000, BufferMode=1)  # disabled
panel_9 = Panel(",")  # disabled
split = TextSplit(Text=dam, Separators=panel_9)  # disabled
item = ListItem(List=split, Index=0, Wrap=True)  # -> Item, Item1, Item2, Item3, Item4, Item5; disabled
trim = TextTrim(Text=item.Item5, Start=True, End=True)  # disabled
# Phone Control
vec = VectorXYZ(XComponent=item.Item, YComponent=item.Item1, ZComponent=item.Item2)  # -> Vector, Length; disabled
vec_2 = VectorXYZ(XComponent=item.Item3, YComponent=item.Item4, ZComponent=trim)  # -> Vector, Length; disabled
vec_phone_acceleration = RemoteSender(vec_2.Vector)  # disabled
vec_phone_orientation = RemoteSender(vec.Vector)  # disabled

# ----
# Density
# Fibre Stress at Elastic Limit
# Modulus of Elasticity (E)
# Compressive Strength Parallel to Grain
# (Shear Strength Parallel to Grain
path = FilePath("D:\Roberto\01 Projects\02 IAAC\02 Curso\Hardware III\Week 4\database_ui_200501\database_ui\wood_data.csv")
file = ReadFile(File=path, PerLineParse=True)
csv = ReadCSV(CSVString=file, Delimiter=",")  # -> Headers, Values
flip = FlipMatrix(Data=csv.Values)
split_2 = SplitList(List=flip, Index="1")  # -> simplify(ListA), simplify(ListB)
cset = CreateSet(List=flatten(split_2.ListA))  # -> Set, Map
txt_available_species = Text(flatten(split_2.ListA))
txt_query = Text()
mindex = MemberIndex(Set=cset.Set, Member=txt_query)  # -> flatten(Index), Count
txt_available_species_2 = RemoteSender(txt_available_species)
branch = TreeBranch(Tree=split_2.ListB, Path=mindex.Index, MaintainPaths=False)
item_2 = ListItem(List=simplify(branch), Index=0, Wrap=True)  # -> Item, Item1, Item2, Item3, Item4
num_strength_compressive = Number(flatten(item_2.Item3))
num_strength_shear = Number(flatten(item_2.Item4))
num_fiber_stress = Number(flatten(item_2.Item1))
num_density = Number(flatten(item_2.Item))
num_e = Number(flatten(item_2.Item2))
panel_10 = Panel("""kg/m3
MPa
GPa
MPa
MPa""")
num_strength_compressive_2 = RemoteSender(num_strength_compressive)
num_strength_shear_2 = RemoteSender(num_strength_shear)
num_fiber_stress_2 = RemoteSender(num_fiber_stress)
num_density_2 = RemoteSender(num_density)
num_e_2 = RemoteSender(num_e)

# ---- group: Testing : Clear Database
command = RDBFileCommand(
    ConnectToggle=Button(),
    SQLCommand="DELETE from items;",
    Connector="SQLite",
    Path="D:\Roberto\01 Projects\02 IAAC\02 Curso\Hardware III\Week 4\database_ui_200501\database_ui\material_database.s3db")
panel_11 = Panel(command)

# ---- group: Gesture Commands
item_3 = ListItem(List=python.raw_signals, Index="0", Wrap=True)
bang = Bang(BooleanInput=item_3)  # -> TrueState, FalseState

item_4 = ListItem(List=python.raw_signals, Index="13", Wrap=True)
bang_2 = Bang(BooleanInput=item_4)  # -> TrueState, FalseState
boolean_command_clear = RemoteSender(bang_2.TrueState)

# ----
panel_12 = Panel("""oak
alder""")
checklist = CreateChecklist(ChecklistItems=panel_12, Selected=False)

max_distance = Slider(0, range=0..100)
slider = CreateSlider(Slider=max_distance, ShowBounds=False, ShowTicks=False, ShowTooltip=False, ShowValLabel=True, showLabel=True)

min_quality = Slider(0, range=0..1)
slider_2 = CreateSlider(Slider=min_quality, ShowBounds=False, ShowTicks=False, ShowTooltip=False, ShowValLabel=True, showLabel=True)

# ---- group: Gesture Commands
boolean_add_delete_2 = RemoteReceiver(boolean_add_delete)
gate = StreamGate(Stream=bang.TrueState, Gate=boolean_add_delete_2)  # -> Target0, Target1
boolean_command_add = RemoteSender(gate.Target1)
boolean_command_delete = RemoteSender(gate.Target0)

# ----
label = CreateLabel(LabelText=" ", LabelSize=12, Justification=0)

# ---- group: Gesture Commands
item_5 = ListItem(List=python.raw_signals, Index="11", Wrap=True)
bang_3 = Bang(BooleanInput=item_5)  # -> TrueState, FalseState
log = DataLog(
    IncomingData=bang_3.TrueState,
    ResetLog=Button(),
    StartRecording=True,
    WrapValues=invert(False),
    RecordingLength=Slider(100, range=0..100))
pccountunique = CountUnique(Key=log, SortIfPossible=False)  # -> KeyList, Count
extremums = MinMax(Number=pccountunique.Count)  # -> Minimum, Maximum

# ---- group: Smooth Orientation Data
vec_phone_orientation_2 = RemoteReceiver(vec_phone_orientation)  # disabled
devec = DeconstructVector(Vector=vec_phone_orientation_2)  # -> XComponent, YComponent, ZComponent; disabled
panel_13 = Panel("10")  # disabled
capacitor = Capacitor(Data=devec.XComponent, Capacity=panel_13)  # disabled
capacitor_2 = Capacitor(Data=devec.YComponent, Capacity=panel_13)  # disabled
capacitor_3 = Capacitor(Data=devec.ZComponent, Capacity=panel_13)  # disabled
num = Number(capacitor_2)  # disabled
num_2 = Number(capacitor_3)  # disabled
num_3 = Number(capacitor)  # disabled
avr = Average(Input=num_3)  # disabled
avr_2 = Average(Input=num)  # disabled
avr_3 = Average(Input=num_2)  # disabled
panel_14 = Panel(avr)  # disabled
num_orientation_a = RemoteSender(avr)  # disabled
num_orientation_b = RemoteSender(avr_2)  # disabled
num_orientation_c = RemoteSender(avr_3)  # disabled

# ----
vre = Slider(3, range=0..10)
slider_3 = CreateSlider(Slider=vre, ShowBounds=False, ShowTicks=False, ShowTooltip=False, ShowValLabel=True, showLabel=True)
tooltip = AttachTooltipToElement(ElementsToAttachTo=slider_3, TooltipContent="Voxel Density", ShowDelay=500, Duration=2000)
values = ValueListener(Elements=slider_3, SomeProperty=True)  # -> Values, Indices

panel_15 = Panel("""Wood
Bricks""")
listbox = CreateListBox(ListItems=panel_15, SelectedIndex=0, Height=Slider(106, range=0..1000))
tooltip_2 = AttachTooltipToElement(ElementsToAttachTo=listbox, TooltipContent="Select Materiality", ShowDelay=500, Duration=2000)

toggle_2 = CreateToggle(Default=False, Label="Mode", OnLabel="Draw", OffLabel="Voxel")
values_2 = ValueListener(Elements=toggle_2, SomeProperty=True)  # -> Values, Indices
mode = RemoteSender(values_2.Values)

path_2 = FilePath("D:\Roberto\01 Projects\02 IAAC\02 Curso\Hardware III\Week 2\Icons\jenga_color2.png")
button = CreateButton(ImagePath=path_2, ButtonStyle=0)
tooltip_3 = AttachTooltipToElement(ElementsToAttachTo=button, TooltipContent="Build Structure", ShowDelay=500, Duration=2000)

path_3 = FilePath("D:\Roberto\01 Projects\02 IAAC\02 Curso\Hardware III\Week 2\Icons\gadget_color2.png")
button_2 = CreateButton(ImagePath=path_3, ButtonStyle=0)
tooltip_4 = AttachTooltipToElement(ElementsToAttachTo=button_2, TooltipContent="Refine Size", ShowDelay=500, Duration=2000)

path_4 = FilePath("D:\Roberto\01 Projects\02 IAAC\02 Curso\Hardware III\Week 2\Icons\interface_color.png")
path_5 = FilePath("D:\Roberto\01 Projects\02 IAAC\02 Curso\Hardware III\Week 2\Icons\Wood_color2.png")

toggle_3 = CreateToggle(Default=False, Label="Position Camera")
values_3 = ValueListener(Elements=toggle_3, SomeProperty=True)  # -> Values, Indices

button_3 = CreateButton(ImagePath=path_4, ButtonStyle=0)
button_4 = CreateButton(ImagePath=path_5, ButtonStyle=0)
tooltip_5 = AttachTooltipToElement(ElementsToAttachTo=button_3, TooltipContent="Save Model", ShowDelay=500, Duration=2000)
tooltip_6 = AttachTooltipToElement(ElementsToAttachTo=button_4, TooltipContent="Fit Resources", ShowDelay=500, Duration=2000)
wrappanel = CreateWrapPanel(UIElements=[button_2, button], Horizontal=True)
wrappanel_2 = CreateWrapPanel(UIElements=[button_3, button_4], Horizontal=True)
# Restart this component to
# see the design tab. (Bug)
number_slider = Slider(26, range=0..100)
panel_16 = Panel("""Design
Database""")

# ---- group: Core Workflow
# Mouse
# Control
mode_2 = RemoteReceiver(mode)
mouse = Mouse(Triger=mode_2)  # -> CursorPosition, LeftMouseButton, MiddleMouseButton, RightMouseButton; disabled
pointer = RemoteSender(mouse.CursorPosition)  # disabled
right_click = RemoteSender(mouse.RightMouseButton)
pointer_2 = RemoteReceiver(pointer)
boolean_command_clear_2 = RemoteReceiver(boolean_command_clear)
cloud = CloudDisplay(Points=pointer_2, Colours=RGB(255, 20, 147), Size=Slider(1, range=0..10), SpriteType=0)

# ----
rhcom = RhinoCommand(SendCommandToggle=Button(), CommandString="Fullscreen")

# ---- group: Core Workflow / Reset Data Recorders
python_2 = PythonScript(Toggle=boolean_command_clear_2)
# ---------- python_2: Python ----------
import Grasshopper as gh

if Toggle:
    
    # Get the Grasshopper document and objects
    ghDoc = ghenv.Component.OnPingDocument()
    ghObjects = ghDoc.Objects
    
    # Iterate the GH objects, check type and reset data recorders
    for obj in ghObjects:
        if type(obj) is gh.Kernel.Special.GH_DataRecorder:
            obj.DestroyRecordedData()
            obj.ExpireSolution(True)
# ---------- end python_2 ----------

# ---- group: Cross Shape
panel_17 = Panel("1,0,0.3")  # disabled
panel_18 = Panel("0,-1,0.3")  # disabled
panel_19 = Panel("0,1,0.3")  # disabled
panel_20 = Panel("-1,0,0.3")  # disabled
ln = Line(StartPoint=panel_20, EndPoint=panel_17)  # disabled
ln_2 = Line(StartPoint=panel_18, EndPoint=panel_19)  # disabled
merge = Merge(Data1=ln, Data2=ln_2)  # disabled
panel_21 = Panel("0.5")  # disabled
scale = Scale(Geometry=merge, Center=Point(0, 0, 0), Factor=panel_21)  # -> Geometry, Transform; disabled
group = Group(Objects=scale.Geometry)  # disabled

# ----
video_stream = WebCamVideoStream()  # disabled
T_2 = StateGate(States=values_2.Values)  # -> True, False
# Webcam Geometry
video_stream_2 = WebCamVideoStream()

# ----
# Position
average = VideoAverages(BitmapToModify=video_stream_2, MinimumPointOfBoundingArea=Point(0, 0, 0), MaximumPointOfBoundingArea=Point(1, 1, 0))  # -> AverageColor, AverageMovementVector, CentroidOfMovement, CentroidOfRedPixels, CentroidOfGreenPixels, CentroidOfBluePixels
pt2num = PointsToNumbers(Points=average.CentroidOfMovement, Mask=4)
pt2num_2 = PointsToNumbers(Points=average.CentroidOfMovement, Mask=4)
avr_4 = Average(Input=pt2num)
smooth = SmoothNumbers(Numbers=pt2num_2, SmoothDelay=2000)
remap = RemapNumbers(Value=smooth, Source=Domain(0.3, 0.6), Target="0.1 to 50")  # -> Mapped, Clipped
remap_2 = RemapNumbers(Value=avr_4, Source=Domain(0.3, 0.6), Target=Domain(1, 1.8))  # -> Mapped, Clipped
num2pt = NumbersToPoints(Numbers=remap.Mapped, Mask=4)
smooth_2 = SmoothNumbers(Numbers=remap_2.Mapped, SmoothDelay=2000)

decompose = BitmapDecompose(BitmapToDecompose=video_stream_2)  # -> RedChannel, GreenChannel, BlueChannel, AlphaChannel, XResolution, YResolution; disabled
build = BuildBitmap(
    Width=decompose.XResolution,
    Height=decompose.YResolution,
    Alpha=decompose.AlphaChannel,
    Red=decompose.RedChannel,
    Green=decompose.GreenChannel,
    Blue=decompose.BlueChannel)  # disabled
edges = FilterEdges(Image=build, Mode=0, NotUsed=1, NotUsed_2=1, NotUsed_3=1, NotUsed_4=1)  # -> Image, Filter; disabled
number_slider_2 = Slider(0.1, range=0..0.1)  # disabled
number_slider_3 = Slider(0.2, range=0..1)  # disabled
number_slider_4 = Slider(0.3, range=0..1)  # disabled
number_slider_5 = Slider(1, range=0..1)  # disabled
number_slider_6 = Slider(0.2, range=0..1)  # disabled
trace = TraceImage(
    Image=edges.Image,
    Mode=0,
    Size=2,
    Error=0.2,
    Threshold=[number_slider_3, number_slider_2, number_slider_4],
    Alpha=number_slider_5)  # disabled
number_slider_7 = Slider(-1, range=-20..10)  # disabled
number_slider_8 = Slider(0, range=0..20)  # disabled
scale_2 = Scale(Geometry=trace, Center=Point(0, 0, 0), Factor=number_slider_6)  # -> Geometry, Transform; disabled
mirror = Mirror(Geometry=scale_2.Geometry, Plane=PlaneYZ(0, 0, 0))  # -> Geometry, Transform; disabled
pt = ConstructPoint(XCoordinate=number_slider_7, YCoordinate=number_slider_8, ZCoordinate=0)  # disabled
move = Move(Geometry=mirror.Geometry, Motion=pt)  # -> Geometry, Transform; disabled
number_slider_9 = Slider(1, range=0..10)  # disabled
previewlw = CustomPreviewLineweights(
    Geometry=move.Geometry,
    Shader={diffuse=RGB(255, 105, 180), emission=RGB(76, 32, 54), shine=0.5, specular=RGB(255, 255, 255), transparency=0},
    Thickness=number_slider_9,
    Absolute=False)  # disabled

cir = Circle(Plane=PlaneXY(0, 0, 0), Radius=1)
shapes = CreateShapes(Shapes=cir, StrokeColor=RGB(0, 0, 0), Scale=1, ClickMode=3)
swatch = ColourSwatch(SwatchColor=RGB(232, 31, 0))
setshapes = SetShapes(
    ShapeToModify=shapes,
    ShapeCurves=move.Geometry,
    FillColors=swatch,
    StrokeWeights=Slider(0.48, range=0..1),
    StrokeColors=swatch,
    Scale=Slider(13, range=0..100),
    Width=Slider(0, range=-100..100),
    Height=Slider(0, range=-100..100))
adjustpos = AdjustElementPositioning(ElementsToAdjust=shapes, AbsolutePositioning=False, HorizontalAlignment=2)

# ---- group: Get Input From Touch-OSC
button_5 = Button()  # disabled
panel_22 = Panel("10000")  # disabled
osc_listener = OSCListener(Port=panel_22, Reset=button_5)  # disabled

# ---- group: Extract Button Presses From OSC Data
item_6 = ListItem(List=osc_listener, Index=0, Wrap=True)  # -> flatten(Item), Item1; disabled
panel_23 = Panel("/oscControl/button1")  # disabled
trim_2 = TextTrim(Text=item_6.Item, Start=True, End=True)  # disabled
tmatch = MatchText(Text=trim_2, RegEx=graft(panel_23), Case=True)  # disabled
dispatch = Dispatch(List=item_6.Item1, DispatchPattern=tmatch)  # -> flatten(ListA), flatten(ListB); disabled
bang_4 = Bang(BooleanInput=dispatch.ListA)  # -> TrueState, FalseState; disabled
bang_5 = Bang(BooleanInput=dispatch.ListB)  # -> TrueState, FalseState; disabled

# ---- group: Core Workflow
multiplication = Multiplication(A=smooth_2, B=Slider(1, range=0..10))
values_4 = ValueListener(Elements=button_2, SomeProperty=True)  # -> Values, Indices
log_2 = DataLog(IncomingData=multiplication, ResetLog=values_4.Values, StartRecording=True, WrapValues=False, RecordingLength=1)
panel_24 = Panel(log_2)
selobj = GetSelectedObjects(AllObjects_Object=panel_63)  # -> ComponentObjects, ParamObjects, OtherObjects
setobj = SetObjectValue(ObjectToSet=selobj.ParamObjects, ValueToSet=panel_24)

# ----
button_6 = Button()  # disabled
frame = Frame(Fitting=3)  # disabled
window = Window(Elements=frame, Launch=button_6, Ctrl=True, FilterMode=3, ScrollH=False, ScrollV=False, Transparent=False)  # -> Window, Elements; disabled

# ----
# Required Plugins :
# - Firefly (OSC Listener)
# - Fologram (Toggling Network Connection)
# - GHowl (UDP Communication)
# - Heteroptera (Stream Smoothing)
# - Telepathy (Wireless Connections)
# 
# Using HyperIMU for Android
# - AKM09912 Orientation
# - Linear Acceleration
# 
# Using TouchOSC for Android
# Step 1)
# Select UPD protocol in HyperIMU app.
# 
# Step 2)
# Look for local IP address. In command prompt type ipconfig. In my case was under Wireless LAN adapter wi-fi. IPv4 Address: _______
# 
# Step 3)
# Put that address in HyperIMU under settings.
# 
# Step 4)
# Match Port number in HyperIMU under settings (2055)
# cyan components require local settings
# e.g. ip address, file path etc.
panel_25 = Panel("20")  # disabled
transform_orientation = RemoteReceiver()  # disabled
panel_26 = Panel("10")  # disabled
number_slider_10 = Slider(-1.7, range=-20..10)  # disabled
number_slider_11 = Slider(-15.4, range=-20..10)  # disabled
number_slider_12 = Slider(0.2, range=0..1)  # disabled
number_slider_13 = Slider(0.3, range=0..1)  # disabled
number_slider_14 = Slider(0.1, range=0..1)  # disabled
vec_3 = VectorXYZ(XComponent=number_slider_10, YComponent=number_slider_11, ZComponent=0)  # -> Vector, Length; disabled
number_slider_15 = Slider(35, range=0..100)  # disabled
number_slider_16 = Slider(-4, range=-20..100)  # disabled
swatch_2 = ColourSwatch(SwatchColor=RGB(252, 0, 34))  # disabled
Z = UnitZ(Factor=1)  # disabled
number_slider_17 = Slider(1, range=0..1)  # disabled
button_7 = Button()  # disabled
Z_2 = UnitZ(Factor=number_slider_17)  # disabled
panel_27 = Panel("0,0,0")  # disabled
timer = Timer(TimerInterval=20, Target=osc_listener)  # disabled
item_7 = ListItem(List=osc_listener, Index=-1, Wrap=True)  # disabled
bool = Boolean(item_7)  # disabled
smartphone_press = RemoteSender(bool)  # disabled
panel_28 = Panel(bool)  # disabled
button_8 = Button()  # disabled
panel_29 = Panel(bang_5.TrueState)  # disabled
panel_30 = Panel("3")  # disabled

# ---- group: Position Tracking Via Acceleraometer
# Use with HyperIMU BMI160 3-axis accelerometer
vec_phone_acceleration_2 = RemoteReceiver(vec_phone_acceleration)  # disabled
panel_31 = Panel("3")  # disabled
capacitor_4 = Capacitor(Data=vec_phone_acceleration_2, Capacity=panel_31)  # disabled
avr_5 = Average(Input=capacitor_4)  # disabled
button_9 = Button()  # disabled
panel_32 = Panel("0,0,0")  # disabled

# ----
# Required Plugins:
# - Human UI (ui)
# - Lunchbox (csv loading)
# - Slingshot! (sql interaction)
# - Telepathy (wireless gh connections)
# White border components are UI controls
# Cyan border components may require reselecting a local filepath
# First Version Data Set
panel_33 = Panel("x BETWEEN {0} AND {1} AND y BETWEEN {2} AND {3} AND z BETWEEN {4} AND {5} AND quality > {6} AND distance < {7}")

capacitor_5 = Capacitor(Data=vec_phone_acceleration_2, Capacity=panel_25)  # disabled
devec_2 = DeconstructVector(Vector=capacitor_5)  # -> XComponent, YComponent, ZComponent; disabled
merge_2 = Merge(Data1=graft(devec_2.XComponent), Data2=graft(devec_2.YComponent), Data3=graft(devec_2.ZComponent))  # disabled
flip_2 = FlipMatrix(Data=merge_2)  # disabled
transform = Transform(Geometry=avr_5, Transform=transform_orientation)  # disabled
python_3 = GhPythonScript(x=transform)  # -> simplify(a); inputs x: Vector3d; disabled
# ---------- python_3: Python ----------
__author__ = "matt"
__version__ = "2020.05.05"

import rhinoscriptsyntax as rs
import ghpythonlib.components as gh

if gh.VectorLength(x) < 0.3:
    a = gh.VectorXYZ(0,0,0)
else:
    a = x
# ---------- end python_3 ----------
graph = QuickGraph(flip_2, SortOrder=0)  # disabled
item_8 = ListItem(List=python_3, Index=0, Wrap=True)  # disabled
panel_34 = Panel(item_8)  # disabled
vlen = VectorLength(Vector=item_8)  # disabled
multiplication_2 = Multiplication(A=item_8, B=panel_26)  # disabled
panel_35 = Panel(vlen)  # disabled

# ---- group: Position Tracking Via Acceleraometer (continued)
vbma = MassAdditiveVectorsBuffer(Reset=button_9, Vectors=item_8)  # disabled
vbma_2 = MassAdditiveVectorsBuffer(Reset=button_9, Vectors=vbma)  # disabled
vdis = VectorDisplay(Anchor=panel_32, Vector=multiplication_2)  # disabled
pt_2 = Point(vbma_2)  # disabled

# ---- group: Testing : Generate Database Entries
number_slider_18 = Slider(1900, range=0..3000)
panel_36 = Panel("0.1 to 0.3")
random = Random(Range="0 to 1", Number=number_slider_18, Seed="3")
random_2 = Random(Range="1 to 100", Number=number_slider_18, Seed="4")
series = Series(Start=0, Step=1, Count=number_slider_18)
panel_37 = Panel("""id
x
y
z
quality
distance
species""")
panel_38 = Panel("""BEGIN TRANSACTION;
COMMIT;""")

# ----
toggle_4 = CreateToggle(Default=False, Label="Query Database")
label_2 = CreateLabel(LabelSize="20", Justification="2")

rangeslider = CreateRangeSlider(SliderRange="0.05 to 2", StartingRange="0.05 to 2")
label_3 = CreateLabel(LabelText="Length Range", LabelSize=12, Justification=0)
merge_3 = Merge(Data1=label_3, Data2=rangeslider)

rangeslider_2 = CreateRangeSlider(SliderRange="0.125 to 0.15", StartingRange="0.125 to 0.15")
label_4 = CreateLabel(LabelText="Width Range", LabelSize=12, Justification=0)
merge_4 = Merge(Data1=label_4, Data2=rangeslider_2)

rangeslider_3 = CreateRangeSlider(SliderRange="0.125 to 0.15", StartingRange="0.125 to 0.15")
label_5 = CreateLabel(LabelText="Height Range", LabelSize=12, Justification=0)
merge_5 = Merge(Data1=label_5, Data2=rangeslider_3)

# ----
# ID
# Length
# Width
# Height
# Quality
# Distance
# Species
# You have to clear the list before committing again
panel_39 = Panel("alder")
cluster = Cluster_5(col=swatch)  # -> S, S_2, S_3, S_4
adjustpos_2 = AdjustElementPositioning(ElementsToAdjust=label_2, AbsolutePositioning=False, HorizontalAlignment=0)
entwine = Entwine(
    Branch00=toggle_4,
    Branch01=cluster.S,
    Branch02=label_2,
    Branch03=cluster.S_2,
    Branch04=checklist,
    Branch05=cluster.S_3,
    Branch06=merge_3,
    Branch07=merge_4,
    Branch08=merge_5,
    Branch09=cluster.S_4,
    Branch010=label,
    Branch011=slider_2,
    Branch012=slider,
    FlattenInputs=True)  # -> flatten(Result)

values_5 = ValueListener(Elements=entwine, SomeProperty=True)  # -> Values, Indices
clean = CleanTree(RemoveNulls=True, RemoveInvalid=True, RemoveEmpty=invert(False), Tree=values_5.Values)
bang_6 = ExplodeTree(Data=clean)  # -> Branch0, Branch1, Branch2, Branch3, Branch4, Branch5, Branch6, Branch7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
domain_length = RemoteSender(bang_6.Branch4)
boolean_query_database = RemoteSender(bang_6.Branch0)
domain_width = RemoteSender(bang_6.Branch6)
domain_height = RemoteSender(bang_6.Branch8)
num_min_quality = RemoteSender(bang_6.Branch10)
num_maximum_distance = RemoteSender(bang_6.Branch11)

domain_length_2 = RemoteReceiver(domain_length)
domain_height_2 = RemoteReceiver(domain_height)
domain_width_2 = RemoteReceiver(domain_width)
num_maximum_distance_2 = RemoteReceiver(num_maximum_distance)
num_min_quality_2 = RemoteReceiver(num_min_quality)
dedomain = DeconstructDomain(Domain=domain_length_2)  # -> Start, End
dedomain_2 = DeconstructDomain(Domain=domain_width_2)  # -> Start, End
dedomain_3 = DeconstructDomain(Domain=domain_height_2)  # -> Start, End
format = Format(
    Format=panel_33,
    Culture=127,
    Data0=dedomain.Start,
    Data1=dedomain.End,
    Data2=dedomain_2.Start,
    Data3=dedomain_2.End,
    Data4=dedomain_3.Start,
    Data5=dedomain_3.End,
    Data6=num_min_quality_2,
    Data7=num_maximum_distance_2)
boolean_query_database_2 = RemoteReceiver(boolean_query_database)
querysfw = SQLSELECTString(Select="*", From="items", Where=format, Connector="MySQL")
query = RDBFileQuery(
    ConnectToggle=boolean_query_database_2,
    SQLQuery=querysfw,
    Database="SQLite",
    Path="D:\Roberto\01 Projects\02 IAAC\02 Curso\Hardware III\Week 4\database_ui_200501\database_ui\material_database.s3db")  # -> Exceptions, TableHeadings, TableData
flip_3 = FlipMatrix(Data=query.TableData)
tstat = TreeStatistics(Tree=flip_3)  # -> Paths, Length, Count
dam_2 = DataDam(DataA=flip_3, BufferDelay=10000000, BufferMode=1)
python_4 = GhPythonScript(n=tstat.Count)  # -> a
# ---------- python_4: Python ----------
__author__ = "matt"
__version__ = "2020.04.26"

import rhinoscriptsyntax as rs

if n == None:
    a = "0"
else:
    a = n
# ---------- end python_4 ----------
item_9 = ListItem(List=simplify(dam_2), Index=0, Wrap=True)  # -> flatten(Item), flatten(Item1), flatten(Item2), flatten(Item3), flatten(Item4), flatten(Item5), flatten(Item6)
num_db_item_count = RemoteSender(python_4)
int = Integer(item_9.Item)
num_4 = Number(item_9.Item1)
num_5 = Number(item_9.Item2)
num_6 = Number(item_9.Item3)
num_7 = Number(item_9.Item4)
num_8 = Number(item_9.Item5)
txt = Text(item_9.Item6)
panel_40 = Panel(num_4)

domain_width_3 = RemoteReceiver(domain_width)
dedomain_4 = DeconstructDomain(Domain=domain_width_3)  # -> Start, End
format_2 = Format(Format="Width Range : ({0} : {1})", Culture=127, Data0=dedomain_4.Start, Data1=dedomain_4.End)
setlabel = SetLabelContents(LabelToModify=label_4, NewLabelContents=format_2)

domain_height_3 = RemoteReceiver(domain_height)
dedomain_5 = DeconstructDomain(Domain=domain_height_3)  # -> Start, End
format_3 = Format(Format="Height Range : ({0} : {1})", Culture=127, Data0=dedomain_5.Start, Data1=dedomain_5.End)
setlabel_2 = SetLabelContents(LabelToModify=label_5, NewLabelContents=format_3)

domain_length_3 = RemoteReceiver(domain_length)
dedomain_6 = DeconstructDomain(Domain=domain_length_3)  # -> Start, End
format_4 = Format(Format="Length Range : ({0} : {1})", Culture=127, Data0=dedomain_6.Start, Data1=dedomain_6.End)
setlabel_3 = SetLabelContents(LabelToModify=label_3, NewLabelContents=format_4)

num_db_item_count_2 = RemoteReceiver(num_db_item_count)
format_5 = Format(Format="Items : {0}", Culture=127, Data0=num_db_item_count_2)
setlabel_4 = SetLabelContents(LabelToModify=label_2, NewLabelContents=format_5)

panel_41 = Panel(format)
panel_42 = Panel(query.TableData)

data = Data(entwine)

# ---- group: Testing : Generate Database Entries (continued)
random_3 = Random(Range="0.05 to 2", Number=number_slider_18, Seed="0")
random_4 = Random(Range="0.125 to 0.15", Number=number_slider_18, Seed="1")
random_5 = Random(Range="0.125 to 0.15", Number=number_slider_18, Seed="2")

# ---- group: Normalizing Hand Position
dom = ConstructDomain(DomainStart=Slider(1.3, range=0..10), DomainEnd=Slider(4, range=0..10))
domain_x_input = Domain("500 to 100")
domain_y_input = Domain("400 to 150")
remap_3 = RemapNumbers(Value=python.x_pos, Source=domain_x_input, Target=dom)  # -> Mapped, Clipped
remap_4 = RemapNumbers(Value=python.y_pos, Source=domain_y_input, Target=dom)  # -> Mapped, Clipped

# ---- group: Move Camera
pt_3 = ConstructPoint(XCoordinate=Slider(4, range=0..40), YCoordinate=Slider(7, range=0..40), ZCoordinate=Slider(20, range=0..40))
panel_43 = Panel("30,0,20")
xz = XZPlane(Origin=Point(0, 0, 0))
rotate = Rotate(Geometry=pt_3, Angle=python.x_rot, Plane=xz)  # -> Geometry, Transform
rotate_2 = Rotate(Geometry=rotate.Geometry, Angle=python.z_rot, Plane=PlaneXY(0, 0, 0))  # -> Geometry, Transform

# ----
panel_44 = Panel("Volume")
chart = CreateChart(Data=Slider(484, range=0..10000), Names="Available Resources", ChartType=4)
adjustpos_3 = AdjustElementPositioning(
    ElementsToAdjust=chart,
    AbsolutePositioning=False,
    Width=Slider(270, range=0..1000),
    Height=Slider(287, range=0..1000),
    HorizontalAlignment=1,
    VerticalAlignment=2)
adjustelem = AdjustElementAppearance(ElementsToAdjust=chart, FontSize=Slider(15, range=0..100))

adjust_for_north = Slider(-27, range=-180..180)  # disabled
num_orientation_a_2 = RemoteReceiver(num_orientation_a)  # disabled
addition = Addition(A=num_orientation_a_2, B=adjust_for_north)  # disabled
rad = Radians(Degrees=addition)  # disabled
neg = Negative(Value=rad)  # disabled
num_orientation_b_2 = RemoteReceiver(num_orientation_b)  # disabled
rad_2 = Radians(Degrees=num_orientation_b_2)  # disabled
neg_2 = Negative(Value=rad_2)  # disabled
num_orientation_c_2 = RemoteReceiver(num_orientation_c)  # disabled
rad_3 = Radians(Degrees=num_orientation_c_2)  # disabled

# ----
# Dataset Geometry
# Goals:
# Less difference between y and z distance
# Largest possible area
# Highest Quality
number_slider_19 = Slider(-36, range=-50..100)
pt_4 = ConstructPoint(XCoordinate=number_slider_19, YCoordinate=Slider(21, range=0..100), ZCoordinate=0)
select_cluster = Slider(1, range=0..5)
yz = YZPlane(Origin=pt_4)

# ---- group: Remake the grid
number_slider_20 = Slider(44, range=0..100)
recgrid = Rectangular(
    Plane=pt_4,
    SizeX=Slider(2.1, range=0..10),
    SizeY=Slider(0.4, range=0..1),
    ExtentX=number_slider_20,
    ExtentY=number_slider_20)  # -> Cells, Points
area = Area(Geometry=recgrid.Cells)  # -> Area, flatten(Centroid)

# ---- group: Core Workflow / 2D Canvas
number_slider_21 = Slider(5, range=0..100)
number_slider_22 = Slider(5, range=0..100)
number_slider_23 = Slider(5, range=0..100)
number_slider_24 = Slider(0.5, range=0..10)
division = Division(A=number_slider_21, B=number_slider_24)
division_2 = Division(A=number_slider_22, B=number_slider_24)
division_3 = Division(A=number_slider_23, B=number_slider_24)
cgrid = CloudGrid(Plane=PlaneXY(0, 0, 0), Size=number_slider_24, ExtentX=division, ExtentY=division_2, ExtentZ=division_3)
decloud = DeconstructCloud(Cloud=cgrid)  # -> Points, Normals, Colors
grid_points = RemoteSender(decloud.Points)
grid_points_2 = RemoteReceiver(grid_points)

# ---- group: Normalizing Hand Position (continued)
series_2 = Series(Start=0, Step=number_slider_24, Count=10)
item_10 = ListItem(List=series_2, Index=extremums.Minimum, Wrap=True)
pt_5 = ConstructPoint(XCoordinate=remap_3.Mapped, YCoordinate=remap_4.Mapped, ZCoordinate=item_10)

# ---- group: Core Workflow / 3D Canvas
center = Center(Geometry=cgrid)  # -> Center, Dimension
multiplication_3 = Multiplication(A=number_slider_24, B=number_slider_21)
multiplication_4 = Multiplication(A=number_slider_24, B=number_slider_22)
multiplication_5 = Multiplication(A=number_slider_24, B=number_slider_23)
box = CenterBox(Base=center.Center, X=multiplication_3, Y=multiplication_4, Z=multiplication_5)
center_point_cloud = RemoteSender(center.Center)
wires = BrepWireframe(Brep=box, Density=-1)
dash = DashPattern(Curve=wires, Pattern=Slider(0.2, range=0..1))  # -> Dashes, Gaps
cloud_2 = CloudDisplay(Points=pt_5, Colours=ColourSwatch(SwatchColor=RGB(251, 0, 255)), Size=Slider(0.3, range=0..1), SpriteType=0)

# ---- group: Move Camera (continued)
camera = CameraCrane(Location=rotate_2.Geometry, Target=center.Center, Lense=Slider(34, range=0..100), ActivationOptional=True)  # -> C, T, L, U, H, V, R, F, SR; disabled

# ----
center_point_cloud_2 = RemoteReceiver(center_point_cloud)  # disabled
move_2 = Move(Geometry=center_point_cloud_2, Motion=vec_3.Vector)  # -> Geometry, Transform; disabled
center_point_cloud_3 = RemoteReceiver(center_point_cloud)  # disabled

# ---- group: Create Phone Model
box_2 = CenterBox(Base=move_2.Geometry, X=number_slider_12, Y=number_slider_13, Z=number_slider_14)  # disabled

# ----
brep = Brep(box_2)  # disabled

center_2 = Center(Geometry=brep)  # -> Center, Dimension; disabled

# ----
# Human UI
cluster_2 = Cluster()  # -> S, S_2, S_3, S_4, S_5, S_6

rotate_3 = Rotate(Geometry=brep, Angle=neg, Plane=center_2.Center)  # -> Geometry, Transform; disabled

center_3 = Center(Geometry=rotate_3.Geometry)  # -> Center, Dimension; disabled

# ---- group: Core Workflow
# Step 2
# Step 9
# Step 6, 7, 8
# Step 1
# Who made the best design in terms of environmental data, performance: Shading and Views
# Step 4
# Step 3
# Step 5
# Step 7
# Step 9
# Step 10
number_slider_25 = Slider(-9, range=-50..10)
panel_45 = Panel("""Right
Left
Up
Down
Top
Bottom""")
panel_46 = Panel("""1
0
1
0
1
0""")
checklist_2 = CreateChecklist(ChecklistItems=panel_45, Selected=panel_46)
toggle_5 = CreateToggle(Default=False, Label="Structure Preview")
toggle_6 = CreateToggle(Default=False, Label="Voxel Preview")
X = UnitX(Factor=number_slider_25)
number_slider_26 = Slider(0.01, range=0..1)
number_slider_27 = Slider(10, range=0..10)
number_slider_28 = Slider(0.4, range=0..1)
number_slider_29 = Slider(0.4, range=0..1)
number_slider_30 = Slider(10, range=0..10)
panel_47 = Panel("Wireframe")
moonlight = Moonlight(Mode=invert(False))
item_11 = ListItem(List=python.raw_signals, Index="10", Wrap=True)
bang_7 = Bang(BooleanInput=item_11)  # -> TrueState, FalseState
values_6 = ValueListener(Elements=button_3, SomeProperty=True)  # -> Values, Indices
values_7 = ValueListener(Elements=listbox, SomeProperty=True)  # -> Values, Indices
values_8 = ValueListener(Elements=toggle_6, SomeProperty=True)  # -> Values, Indices
T_3 = StateGate(States=values_8.Values, LinkTarget=mesh)  # -> True, False
number_slider_31 = Slider(100, range=0..100)
X_2 = XSize(Domain(-0.0625, 0.0625))
R = Radius(0)

# ---- group: Core Workflow / 2D Canvas (continued)
cloud_3 = CloudDisplay(Points=grid_points_2, Colours=ColourSwatch(SwatchColor=RGB(168, 168, 168)), Size=number_slider_26, SpriteType=0)

# ---- group: Core Workflow
panel_48 = Panel("Arctic")
mod_viewport = ModifyViewport(ViewportName="Perspective", DisplayMode=panel_47, AnimateRestore=False, RestoreFrames=10)

number_slider_32 = Slider(1, range=0..1)
center_4 = Center(Geometry=cgrid)  # -> Center, Dimension
Z_3 = UnitZ(Factor=Slider(42, range=0..100))

# ----
yz_2 = YZPlane(Origin=center_3.Center)  # disabled
transform_2 = Transform(Geometry=yz_2, Transform=rotate_3.Transform)  # disabled
rotate_4 = Rotate(Geometry=rotate_3.Geometry, Angle=neg_2, Plane=transform_2)  # -> Geometry, Transform; disabled

# ---- group: Core Workflow (continued)
vec_4 = VectorXYZ(XComponent=number_slider_25, YComponent=0, ZComponent=Z_3)  # -> Vector, Length
move_3 = Move(Geometry=center_4.Center, Motion=X)  # -> Geometry, Transform
Y = UnitY(Factor=number_slider_32)

move_4 = Move(Geometry=center_4.Center, Motion=vec_4.Vector)  # -> Geometry, Transform
camera_2 = CameraCrane(
    LocationOptional=move_4.Geometry,
    TargetOptional=move_3.Geometry,
    LensOptional=Slider(19, range=0..100),
    UpOptional=Y,
    ViewNameOptional="Perspective",
    Size=2,
    ActivationOptional=values_3.Values)  # -> LocationOptional, TargetOptional, LensOptional, UpOptional, FRect, BRect, HorizontalViewAngle, VerticalViewAngle, ScreenRatio

# ----
lng = ListLength(List=area.Centroid)
panel_49 = Panel(lng)
box_3 = DomainBox(Base=area.Centroid, X=num_4, Y=num_5, Z=num_6)  # -> simplify(Box)

box_corners = BoxCorners(Box=box_3)  # -> CornerA, CornerB, CornerC, CornerD, CornerE, CornerF, CornerG, CornerH
volume = Volume(Geometry=box_3)  # -> Volume, Centroid
dist = Distance(PointA=box_corners.CornerA, PointB=box_corners.CornerE)
dist_2 = Distance(PointA=box_corners.CornerA, PointB=box_corners.CornerB)
dist_3 = Distance(PointA=box_corners.CornerB, PointB=box_corners.CornerC)
bnd = Bounds(Numbers=flatten(volume.Volume))
bnd_2 = Bounds(Numbers=flatten(dist_2))
bnd_3 = Bounds(Numbers=flatten(dist_3))
bnd_4 = Bounds(Numbers=flatten(dist))
remap_5 = RemapNumbers(Value=dist_2, Source=bnd_2, Target=Domain(0, 1))  # -> Mapped, Clipped
remap_6 = RemapNumbers(Value=volume.Volume, Source=bnd, Target=Domain(0, 1))  # -> Mapped, Clipped
remap_7 = RemapNumbers(Value=dist_3, Source=bnd_3, Target=Domain(0, 1))  # -> Mapped, Clipped
remap_8 = RemapNumbers(Value=dist, Source=bnd_4, Target=Domain(0, 1))  # -> Mapped, Clipped
merge_6 = Merge(Data1=graft(remap_5.Mapped), Data2=graft(remap_7.Mapped), Data3=graft(remap_8.Mapped))  # -> simplify(Result)
datatree_to_tensorset = DataTreeToTensorSet(DataTree=merge_6)  # -> simplify(TensorSet); "DT->TS"
kmeans = KMeansClustering(Data=datatree_to_tensorset, Clusters=Slider(2, range=0..100), Iterations=Slider(1000, range=0..1000), Seed=123)  # -> Clusters, Indices

# ---- group: Cluster Distances
item_12 = ListItem(List=flatten(num_8), Index=kmeans.Indices, Wrap=True)
branch_2 = TreeBranch(Tree=simplify(item_12), Path=select_cluster, MaintainPaths=True)
num_cluster_distances = RemoteSender(branch_2)

# ---- group: Cluster Species
item_13 = ListItem(List=flatten(txt), Index=kmeans.Indices, Wrap=True)
branch_3 = TreeBranch(Tree=simplify(item_13), Path=select_cluster, MaintainPaths=True)

# ---- group: Load Wood Datset
# Density
# Fibre Stress at Elastic Limit
# Modulus of Elasticity (E)
# Compressive Strength Parallel to Grain
# (Shear Strength Parallel to Grain
path_6 = FilePath("C:\Users\matt\Documents\iaac\studio_3\wood_data.csv")
file_2 = ReadFile(File=path_6, PerLineParse=True)
csv_2 = ReadCSV(CSVString=file_2, Delimiter=",")  # -> Headers, Values
flip_4 = FlipMatrix(Data=csv_2.Values)
split_3 = SplitList(List=flip_4, Index="1")  # -> simplify(ListA), simplify(ListB)
tensor = ConstructTensor(Values=split_3.ListB)
txt_available_species_3 = Text(flatten(split_3.ListA))
keysearch = KeyValueSearch(Keys=flatten(split_3.ListA), Values=flatten(tensor), Search=branch_3)
txt_available_species_4 = RemoteSender(txt_available_species_3)
detensor = DeconstructTensor(Tensor=keysearch)
item_14 = ListItem(List=simplify(detensor), Index=0, Wrap=True)  # -> Item, Item1, Item2, Item3, Item4
num_strength_compressive_3 = Number(flatten(item_14.Item3))
num_strength_shear_3 = Number(flatten(item_14.Item4))
num_fiber_stress_3 = Number(flatten(item_14.Item1))
num_density_3 = Number(flatten(item_14.Item))
num_e_3 = Number(flatten(item_14.Item2))
num_density_4 = RemoteSender(num_density_3)

# ---- group: Testing : Generate Database Entries (continued)
txt_available_species_5 = RemoteReceiver([txt_available_species_2, txt_available_species_4])
lng_2 = ListLength(List=txt_available_species_5)
random_6 = Random(Range=lng_2, Number=number_slider_18, Seed="5")
int_2 = Integer(random_6)
item_15 = ListItem(List=txt_available_species_5, Index=int_2, Wrap=True)
merge_7 = Merge(
    Data1=graft(series),
    Data2=graft(random_3),
    Data3=graft(random_4),
    Data4=graft(random_5),
    Data5=graft(random),
    Data6=graft(random_2),
    Data7=graft(item_15))
sqlformatrows = SQLFormatRows(RowDataList=merge_7)  # -> flatten(RowStrings)
insert = SQLInsertCommand(Table="items", Columns=panel_37, Data=sqlformatrows, Update=False, Connector="MySQL")
ins = InsertItems(List=panel_38, Item=insert, Indices="1", Wrap=True)
command_2 = RDBFileCommand(
    ConnectToggle=Button(),
    SQLCommand=ins,
    Connector="SQLite",
    Path="D:\Roberto\01 Projects\02 IAAC\02 Curso\Hardware III\Week 4\database_ui_200501\database_ui\material_database.s3db")
panel_51 = Panel(command_2)

# ----
entwine_2 = Entwine(
    Branch00=toggle_2,
    Branch01=toggle_6,
    Branch02=toggle_5,
    Branch03=cluster_2.S,
    Branch04=toggle_3,
    Branch05=cluster_2.S_2,
    Branch06=listbox,
    Branch07=cluster_2.S_3,
    Branch08=slider_3,
    Branch09=cluster_2.S_4,
    Branch010=wrappanel,
    Branch011=cluster_2.S_6,
    Branch012=shapes,
    Branch013=cluster_2.S_5,
    Branch014=wrappanel_2,
    Branch015=cluster_2.S_5,
    Branch016=checklist_2,
    FlattenInputs=True)  # -> flatten(Result)

tabs = TabbedView(TabNames=panel_16, TabTextSize=number_slider, Tab0=flatten(entwine_2), Tab1=flatten(data))

center_5 = Center(Geometry=rotate_4.Geometry)  # -> Center, Dimension; disabled
xz_2 = XZPlane(Origin=center_5.Center)  # disabled

rotate_5 = Rotate(Geometry=rotate_4.Geometry, Angle=rad_3, Plane=xz_2)  # -> Geometry, Transform; disabled
merge_8 = Merge(Data2=rotate_5.Transform)  # disabled
comp = Compound(Transforms=merge_8)  # disabled
transform_3 = Transform(comp)  # disabled
brep_2 = Brep(rotate_5.Geometry)  # disabled
transform_phone_orientation = RemoteSender(transform_3)  # disabled

debrep = DeconstructBrep(Brep=rotate_5.Geometry)  # -> Faces, Edges, Vertices; disabled
item_16 = ListItem(List=debrep.Faces, Index=2, Wrap=True)  # disabled
faceface = FaceFaceOffset(Mesh=item_16, Distance=number_slider_15)  # -> Offset, Beams; disabled
center_6 = Center(Geometry=item_16)  # -> Center, Dimension; disabled
center_7 = Center(Geometry=faceface.Offset)  # -> Center, Dimension; disabled
faceface_2 = FaceFaceOffset(Mesh=item_16, Distance=number_slider_16)  # -> Offset, Beams; disabled
ln_3 = Line(StartPoint=center_6.Center, EndPoint=center_7.Center)  # disabled
preview = CustomPreview(Geometry=brep_2, Material=swatch_2)  # disabled
center_8 = Center(Geometry=faceface_2.Offset)  # -> Center, Dimension; disabled
ray_tracer = RemoteSender(ln_3)  # disabled
move_5 = Move(Geometry=center_8.Center, Motion=Z)  # -> Geometry, Transform; disabled
center_9 = Center(Geometry=brep_2)  # -> Center, Dimension; disabled

# ---- group: Core Workflow / Input From Phone Pointer
smartphone_press_2 = RemoteReceiver(smartphone_press)
ray_tracer_2 = RemoteReceiver(ray_tracer)
gate_2 = StreamGate(Data=pt_5, PassingSwitch=bang.TrueState)

# ---- group: Core Workflow
number_slider_33 = Slider(3, range=0..10)
grid_points_3 = RemoteReceiver(grid_points)
msphere = MeshSphere(Base=grid_points_3, Radius=Slider(0.1, range=0..1), UCount=number_slider_33, VCount=number_slider_33)
msphere_2 = MeshSphere(Base=gate_2, Radius=number_slider_28, UCount=number_slider_27, VCount=number_slider_27)
hand_collision = CollisionOneMany(Collider=msphere_2, Obstacles=msphere)  # -> Collision, Index
larger = LargerThan(FirstNumber=hand_collision.Index, SecondNumber=1)  # -> LargerThan, OrEqualTo
dcon = DeleteConsecutive(Set=larger.LargerThan, Wrap=False)  # -> Set, Count
gate_3 = StreamGate(Data=hand_collision.Index, PassingSwitch=dcon.Set)

# ---- group: Core Workflow / Freeform Modelling
grid_points_4 = RemoteReceiver(grid_points)
boolean_command_delete_2 = RemoteReceiver(boolean_command_delete)
boolean_command_clear_3 = RemoteReceiver(boolean_command_clear)
boolean_command_add_2 = RemoteReceiver(boolean_command_add)
item_17 = ListItem(List=grid_points_4, Index=0, Wrap=True)
super_matt_script = GhPythonScript(
    reset=boolean_command_clear_3,
    initial=item_17,
    camera_location=move_5.Geometry,
    ray=ray_tracer_2,
    grid_points=grid_points_3,
    add=Button(),
    remove=boolean_command_delete_2,
    mouse_state=Toggle(False))  # -> out, a, b; inputs reset: Boolean, initial: Point3d, camera_location: Point3d, ray: Curve, grid_points: list of Point3d, add: Boolean, mouse_state: Boolean; disabled
# ---------- super_matt_script: Python ----------
__author__ = "matt"
__version__ = "2020.05.14"

import rhinoscriptsyntax as rs
import scriptcontext as sc
import ghpythonlib.components as gh

# === DEFINITIONS ===
                
def scan_remove(test_distance = 0.05):
    for point in points:
        for existing in sc.sticky["data"]:
            if existing == None:
                continue
            if gh.Distance(point,existing) < test_distance:
                return(existing)
                
def scan_add(test_distance = 5.05):
    for point in points:
        for existing in sc.sticky["data"]:
            if existing == None:
                continue
            if gh.Distance(point,existing) < test_distance:
                return(point)




# === MAIN SCRIPT ===

# Reinitialize if necessary
if not 'data' in sc.sticky:
    sc.sticky["data"] = [initial]
    
closest_points = gh.CurveClosestPoint(grid_points,ray)[0]
x1_l,y1_l,z1_l = gh.Deconstruct(grid_points)
x2_l,y2_l,z2_l= gh.Deconstruct(closest_points)

# Find list of points representing voxels intersected by thre ray
good_points = []
for x1,y1,z1,x2,y2,z2 in zip(x1_l,y1_l,z1_l,x2_l,y2_l,z2_l):
    if (abs(x1-x2) < 2.5) and (abs(y1-y2)< 2.5) and (abs(z1-z2) < 2.5):
        good_points.append(True)
    else:
        good_points.append(False)

# Seperate and sort those points
points = gh.Dispatch(grid_points,good_points)[0]
points_distances = gh.Distance(camera_location,points)
points = gh.SortList(points_distances,points)[1]

if points is None:
    points = []


    

if add:
    point = scan_add()
    if point is not None:
        sc.sticky["data"].append(point)
    
elif remove:
    point = scan_remove()
    sc.sticky["data"].remove(point)
    
elif reset:
    sc.sticky["data"] = [initial]
    
else:
    if mouse_state:
        b = scan_add()
    else:
        b = scan_remove()
    
a = sc.sticky["data"]
# ---------- end super_matt_script ----------
number_slider_34 = Slider(0.2, range=0..1)
cullpt = CullDuplicates(Points=super_matt_script.a, Tolerance=0.1, CullMode=3)  # -> Points, Indices, Valence
box_4 = CenterBox(Base=super_matt_script.b, X=number_slider_34, Y=number_slider_34, Z=number_slider_34)
pt_6 = Point(cullpt.Points)
box_5 = CenterBox(Base=pt_6, X=number_slider_34, Y=number_slider_34, Z=number_slider_34)

# ---- group: Core Workflow / Mouse Collision
clickm = ClickableMesh(Enable=mode_2, Meshes=msphere)  # -> SelectedMeshes, SelectedIndices, MouseLine

# ---- group: Adjust Rhino Camera
panel_52 = Panel("0,-50,5")  # disabled
Z_4 = UnitZ(Factor=1)  # disabled
transform_4 = Transform(Geometry=panel_52, Transform=transform_3)  # disabled
transform_5 = Transform(Geometry=Z_4, Transform=transform_3)  # disabled
panel_53 = Panel("3")  # disabled
capacitor_6 = Capacitor(Data=center_8.Center, Capacity=panel_53)  # disabled
capacitor_7 = Capacitor(Data=transform_5, Capacity=panel_53)  # disabled
avr_6 = Average(Input=capacitor_6)  # disabled
avr_7 = Average(Input=capacitor_7)  # disabled
camera_3 = CameraCrane(Location=move_5.Geometry, Target=center_point_cloud_3, UPVector=Z_2, Refresh=button_7, ActivationOptional=True)  # -> C, T, L, U, H, V, R, F, SR; disabled

# ---- group: Core Workflow / Pointer Collision
collision_one_many = CollisionOneMany(Collider=gate_2, Obstacles=msphere)  # -> Collision, Index

# ---- group: Create Ray
transform_6 = Transform(Geometry=center_9.Center, Transform=transform_3)  # disabled
panel_54 = Panel("0,0,0")  # disabled
ln_4 = Line(StartPoint=center_9.Center, EndPoint=transform_6)  # disabled

# ---- group: Core Workflow
rec = DataRecorder(hand_collision.Index, DataLimit=-10, RecordData=True)
pccountunique_2 = CountUnique(Key=flatten(rec), SortIfPossible=False)  # -> KeyList, Count
grid_points_5 = RemoteReceiver(grid_points)
item_18 = ListItem(List=grid_points_5, Index=pccountunique_2.KeyList, Wrap=True)
pline = PolyLine(Vertices=item_18, Closed=False)
explode = Explode(Curve=pline, Recursive=True)  # -> Segments, Vertices
number_slider_35 = Slider(0.5, range=0..10)
bang_8 = ExplodeTree(Data=explode.Segments)  # -> Branch0, Branch1
divlength = DivideLength(Curve=bang_8.Branch0, Length=number_slider_35)  # -> Points, Tangents, Parameters
divlength_2 = DivideLength(Curve=bang_8.Branch1, Length=number_slider_35)  # -> Points, Tangents, Parameters
grid_points_6 = RemoteReceiver(grid_points)
grid_points_7 = RemoteReceiver(grid_points)
cps = ClosestPoints(Point=flatten(divlength.Points), Cloud=grid_points_6, Count=1)  # -> flatten(ClosestPoint), CPIndex, Distance
cps_2 = ClosestPoints(Point=divlength_2.Points, Cloud=grid_points_7, Count=1)  # -> flatten(ClosestPoint), CPIndex, Distance
cloud_4 = CloudDisplay(Points=cps.ClosestPoint, Colours=RGB(0, 255, 187), Size=1, SpriteType=0)
entwine_3 = Entwine(Branch00=cps.ClosestPoint, Branch01=cps_2.ClosestPoint, FlattenInputs=True)

# ----
panel_55 = Panel("0,100,0")  # disabled
panel_56 = Panel("2.5")  # disabled
line = Line(ln_4)  # disabled
panel_57 = Panel("21")  # disabled
panel_58 = Panel("32")  # disabled
xz_3 = XZPlane(Origin=panel_55)  # disabled
expression = Expression(x=panel_58, y=panel_56, Expression="-int(x/2) * y")  # disabled
expression_2 = Expression(x=panel_57, y=panel_56, Expression="-int(x/2) * y")  # disabled
multiplication_6 = Multiplication(A=panel_56, B=panel_58)  # disabled
multiplication_7 = Multiplication(A=panel_56, B=panel_57)  # disabled
plx = LinePlane(Line=line, Plane=xz_3)  # -> Point, ParamL, ParamP; disabled
sqgrid = Square(Plane=xz_3, Size=panel_56, ExtentX=panel_58, ExtentY=panel_57)  # -> Cells, Points; disabled
rectangle = Rectangle(Plane=xz_3, XSize=multiplication_6, YSize=multiplication_7, Radius=0)  # -> Rectangle, Length; disabled
vec_5 = VectorXYZ(XComponent=expression, YComponent=0, ZComponent=expression_2)  # -> Vector, Length; disabled
xz_4 = XZPlane(Origin=sqgrid.Points)  # disabled
srf = Surface(rectangle.Rectangle)  # disabled
panel_59 = Panel("100,100,200")  # disabled
orient = Orient(Geometry=group, Source=PlaneXY(0, 0, 0), Target=xz_4)  # -> simplify(Geometry), Transform; disabled
panel_60 = Panel("0.75")  # disabled
panel_61 = Panel("200,200,200")  # disabled
material = CreateMaterial(Diffuse=panel_59, Specular=RGB(255, 255, 255), Emission=RGB(0, 0, 0), Transparency=panel_60, Shine=0)  # disabled
move_6 = Move(Geometry=srf, Motion=vec_5.Vector)  # -> Geometry, Transform; disabled
move_7 = Move(Geometry=orient.Geometry, Motion=vec_5.Vector)  # -> Geometry, Transform; disabled
pt_intersection = Point(plx.Point)  # disabled
preview_2 = CustomPreview(Geometry=move_7.Geometry, Material=panel_61)  # disabled
preview_3 = CustomPreview(Geometry=move_6.Geometry, Material=material)  # disabled

# ---- group: Snap Points to Grid
panel_62 = Panel("round(a/2.5) * 2.5")  # disabled
pdecon = Deconstruct(Point=pt_intersection)  # -> XComponent, YComponent, ZComponent; disabled
eval = Evaluate(F=panel_62, a=pdecon.XComponent)  # disabled
eval_2 = Evaluate(F=panel_62, a=pdecon.YComponent)  # disabled
eval_3 = Evaluate(F=panel_62, a=pdecon.ZComponent)  # disabled
pt_7 = ConstructPoint(XCoordinate=eval, YCoordinate=eval_2, ZCoordinate=eval_3)  # disabled

# ---- group: Core Workflow
box_6 = CenterBox(Base=cps.ClosestPoint, X=number_slider_29, Y=number_slider_29, Z=number_slider_29)
center_10 = Center(Geometry=box_6)  # -> Center, Dimension
panel_63 = Panel("0.2")
mode_3 = RemoteReceiver(mode)
gate_4 = StreamGate(Data=panel_63, PassingSwitch=invert(mode_3))
scale_3 = Scale(Geometry=box_6, Center=center_10.Center, Factor=gate_4)  # -> Geometry, Transform
slfastmesh = SlFastMesh(BReps=scale_3.Geometry, EdgeLength=number_slider_30)
slrelax = SlRelax(Mesh=slfastmesh, Steps=Slider(1, range=0..10))

button_10 = Button()
wbcatmullclark = WeaverbirdsCatmullClarkSubdivision(MeshCurves=slrelax, Level=Slider(2, range=0..10), SmoothNakedEdges=1)
center_11 = Center(Geometry=scale_3.Geometry)  # -> Center, Dimension

values_9 = ValueListener(Elements=checklist_2, SomeProperty=True)  # -> Values, Indices
cluster_3 = Cluster_4(T=button_10, d0=wbcatmullclark, V=center_11.Center, B=values.Values, i=values_9.Values)

# ----
volume_2 = Volume(Geometry=cluster_3)  # -> Volume, Centroid
ma = MassAddition(Input=volume_2.Volume)  # -> Result, PartialResults
multiplication_8 = Multiplication(A=ma.Result, B=Slider(0, range=-1..2))
panel_64 = Panel(multiplication_8)
subtraction = Subtraction(A="15", B=ma.Result)
multiplication_9 = Multiplication(A=subtraction, B=100)
division_4 = Division(A=multiplication_9, B="15")

round = Round(Number=division_4)  # -> Nearest, Floor, Ceiling

setchart = SetChartContents(ChartToModify=chart, NewChartValues=round.Nearest)

stack = CreateStack(UIElements=entwine_2, Horizontal=invert(True))
toggle_7 = BooleanToggle(True)
panel_65 = Panel("Brandish")
adjustelem_2 = AdjustElementAppearance(
    ElementsToAdjust=[entwine_2, data],
    Foreground=ColourSwatch(SwatchColor=RGB(112, 112, 112)),
    Background=ColourSwatch(SwatchColor=RGBA(128, 128, 128, 0)),
    FontSize=Slider(14, range=0..100))

launchwin = LaunchWindow(
    Show=toggle_7,
    Name="Control Window",
    Width=Slider(247, range=0..1000),
    Height=Slider(1048, range=0..1200),
    FontFamily="8BIT WONDER",
    ChildStatus=0,
    EnableHorizScroll=False)

addelems = AddElements(Window=launchwin, Elements=flatten(tabs), DoVLChecking=True)  # -> AddedElements, ElementNames
winprops = SetWindowProperties(Window=launchwin, StartingLocation="0,0", Theme=0, AccentColor="Red", ShowTitleBar=invert(True), ScaleFactor=1)

# ---- group: Core Workflow (continued)
preview_4 = CustomPreview(Geometry=msphere_2, Material=ColourSwatch(SwatchColor=RGB(255, 0, 51)))
panel_66 = Panel(rec)
pline_2 = PolyLine(Vertices=flatten(entwine_3), Closed=False)
previewlw_2 = CustomPreviewLineweights(
    Geometry=pline_2,
    Shader={diffuse=RGB(0, 206, 209), emission=RGB(76, 32, 54), shine=0.5, specular=RGB(255, 255, 255), transparency=0},
    Thickness=Slider(1, range=0..10),
    Absolute=False)
scale_4 = Scale(Geometry=box_6, Center=center_10.Center, Factor=smooth_2)  # -> Geometry, Transform
wires_2 = BrepWireframe(Brep=scale_4.Geometry, Density=-1)
dash_2 = DashPattern(Curve=wires_2, Pattern=Slider(0.1, range=0..1))  # -> Dashes, Gaps

# ----
chart_2 = CreateChart(Data=Slider(20, range=0..100), Names="Exterior Solar Radiation", ChartType=4)
chart_3 = CreateChart(Data=Slider(20, range=0..100), Names="Interior Solar Radiation", ChartType=4)
# Firefly
number_slider_36 = Slider(15, range=0..100)
adjustpos_4 = AdjustElementPositioning(
    ElementsToAdjust=chart_2,
    AbsolutePositioning=False,
    Width=Slider(270, range=0..1000),
    Height=Slider(287, range=0..1000),
    HorizontalAlignment=1,
    VerticalAlignment=2)
adjustpos_5 = AdjustElementPositioning(
    ElementsToAdjust=chart_3,
    AbsolutePositioning=False,
    Width=Slider(270, range=0..1000),
    Height=Slider(287, range=0..1000),
    HorizontalAlignment=1,
    VerticalAlignment=2)
adjustelem_3 = AdjustElementAppearance(ElementsToAdjust=chart_2, FontSize=Slider(15, range=0..100))
adjustelem_4 = AdjustElementAppearance(ElementsToAdjust=chart_3, FontSize=number_slider_36)
number_slider_37 = Slider(227, range=0..1000)
entwine_4 = Entwine(Branch00=chart, Branch01=chart_2, Branch02=chart_3, FlattenInputs=True)
toggle_8 = BooleanToggle(False)
stack_2 = CreateStack(UIElements=entwine_4, Horizontal=invert(True))
launchwin_2 = LaunchWindow(
    Show=toggle_7,
    Name="Control Window",
    Width=number_slider_37,
    Height=Slider(1034, range=0..1100),
    FontFamily="Brandish",
    ChildStatus=0,
    EnableHorizScroll=False)
addelems_2 = AddElements(Window=launchwin_2, Elements=flatten(stack_2), DoVLChecking=True)  # -> AddedElements, ElementNames
childwin = MakeChildWindow(ParentWindow=launchwin, ChildWindow=launchwin_2)
subtraction_2 = Subtraction(A="1920", B=number_slider_37)
concat = Concatenate(FragmentA=subtraction_2, FragmentC=",", FragmentB="0")
winprops_2 = SetWindowProperties(Window=launchwin_2, StartingLocation=concat, Theme=0, AccentColor="Red", ShowTitleBar=invert(True), ScaleFactor=1)
adjustelem_5 = AdjustElementAppearance(
    ElementsToAdjust=addelems_2.AddedElements,
    Foreground=swatch,
    Background=ColourSwatch(SwatchColor=RGBA(255, 255, 255, 0)),
    FontSize=Slider(17, range=0..100))

# ---- group: Cluster Boxes
item_19 = ListItem(List=flatten(box_3), Index=kmeans.Indices, Wrap=True)

# ----
rotate_6 = Rotate(Geometry=item_19, Angle=degrees(90), Plane=yz)  # -> Geometry, Transform

# ---- group: Cluster Boxes (continued)
branch_4 = TreeBranch(Tree=simplify(rotate_6.Geometry), Path=select_cluster, MaintainPaths=True)
volume_3 = Volume(Geometry=branch_4)  # -> Volume, Centroid
num_cluster_box_volumes = RemoteSender(volume_3.Volume)
box_cluster_boxes = RemoteSender(branch_4)

# ----
bang_9 = ExplodeTree(Data=rotate_6.Geometry)  # -> Branch0, Branch1, Branch2, Branch3, Branch4, Branch5
swatch_3 = ColourSwatch(SwatchColor=RGB(247, 0, 0))
swatch_4 = ColourSwatch(SwatchColor=RGB(173, 247, 0))
swatch_5 = ColourSwatch(SwatchColor=RGB(0, 247, 165))
preview_5 = CustomPreview(Geometry=bang_9.Branch0, Material=swatch_5)
preview_6 = CustomPreview(Geometry=bang_9.Branch1, Material=swatch_5)
preview_7 = CustomPreview(Geometry=bang_9.Branch2, Material=swatch_5)
preview_8 = CustomPreview(Geometry=bang_9.Branch3, Material=ColourSwatch(SwatchColor=RGB(0, 214, 247)))
preview_9 = CustomPreview(Geometry=bang_9.Branch4, Material=ColourSwatch(SwatchColor=RGB(74, 0, 247)))
preview_10 = CustomPreview(Geometry=bang_9.Branch5, Material=ColourSwatch(SwatchColor=RGB(247, 0, 186)))

ln_5 = Line(StartPoint=panel_27, EndPoint=plx.Point)  # disabled
dispatch_2 = Dispatch(List=pt_7, DispatchPattern=bang_4.TrueState)  # -> ListA, ListB; disabled

c_rec_ctrl = CSharpScript(clean=bang_5.TrueState, pause=button_8)  # -> out, pause_state; inputs clean: Boolean, pause: Boolean; disabled
# ---------- c_rec_ctrl: C# usings ----------
using System.IO;
using System.Linq;
using System.Data;
using System.Drawing;
using System.Reflection;
using System.Windows.Forms;
using System.Xml;
using System.Xml.Linq;
using System.Runtime.InteropServices;

using Rhino.DocObjects;
using Rhino.Collections;
using GH_IO;
using GH_IO.Serialization;
# ---------- c_rec_ctrl: C# ----------
    //iterate through all the objects of the grashopper document;
    foreach (object obj in GrasshopperDocument.Objects) {
      //check only for the GH_DataRecorder components
      if (obj is Grasshopper.Kernel.Special.GH_DataRecorder) {
        //cast the obj into GH_DataRecorder wrapper class to be able to access its methods
        Grasshopper.Kernel.Special.GH_DataRecorder dataDestroy = (Grasshopper.Kernel.Special.GH_DataRecorder) obj;

        if (dataDestroy.NickName == "Rec : Points") {
          //store the recording state of the component in a temp boolean
          bool recState = dataDestroy.RecordData;

          if(clean) {
            //clean the data and reset the recorder component
            dataDestroy.DestroyRecordedData();
            dataDestroy.ExpireSolution(true);
          }
          if(pause) {
            dataDestroy.RecordData = !recState;
            recState = dataDestroy.RecordData;
          }
          pause_state = recState;
        }
       
      }
    }
# ---------- end c_rec_ctrl ----------
rec_points = DataRecorder(dispatch_2.ListA, DataLimit=-10, RecordData=True)  # disabled

dcon_2 = DeleteConsecutive(Set=rec_points, Wrap=False)  # -> Set, Count; disabled
pt_8 = Point(dcon_2.Set)  # disabled
pline_3 = PolyLine(Vertices=pt_8, Closed=False)  # disabled
lng_3 = ListLength(List=pt_8)  # disabled
reb = RebuildCurve(Curve=pline_3, Degree=panel_30, Count=lng_3, Tangents=False)  # disabled

box_cluster_boxes_2 = RemoteReceiver(box_cluster_boxes)
box_corners_2 = BoxCorners(Box=box_cluster_boxes_2)  # -> CornerA, CornerB, CornerC, CornerD, CornerE, CornerF, CornerG, CornerH
ln_6 = Line(StartPoint=box_corners_2.CornerA, EndPoint=box_corners_2.CornerC)
len = Length(Curve=ln_6)
box_cluster_boxes_3 = RemoteReceiver(box_cluster_boxes)

lng_4 = ListLength()
loop_start = LoopStart(N=lng_4, T=Button(), D0=len)  # -> port, Counter, Data, Data_2
item_20 = ListItem(Index=loop_start.Counter, Wrap=True)
panel_67 = Panel(loop_start.Counter)
fsim = FindSimilarMember(Data=item_20, Set=loop_start.Data)  # -> Hit, Index
cull_i = CullIndex(List=loop_start.Data, Indices=fsim.Index, Wrap=True)
loop_end = LoopEnd(
    port=loop_start.port,
    Exit=False,
    Data=cull_i,
    Data_2=fsim.Index,
    TimeOutVal=0,
    pausedState=False,
    state="Constant & Record")  # -> D0, flatten(D1)
int_selected_ids = Integer(loop_end.D1)
int_selected_ids_2 = RemoteSender(int_selected_ids)

# ---- group: Calculate Shipping Costs (This needs more research)
int_selected_ids_3 = RemoteReceiver(int_selected_ids_2)
num_cluster_box_volumes_2 = RemoteReceiver(num_cluster_box_volumes)
num_cluster_distances_2 = RemoteReceiver(num_cluster_distances)
num_density_5 = RemoteReceiver([num_density_4, num_density_2])
item_21 = ListItem(List=num_density_5, Index=int_selected_ids_3, Wrap=True)
item_22 = ListItem(List=num_cluster_box_volumes_2, Index=int_selected_ids_3, Wrap=True)
item_23 = ListItem(List=num_cluster_distances_2, Index=int_selected_ids_3, Wrap=True)
num_kg_m3 = Number(item_21)
num_m3 = Number(item_22)
num_km = Number(item_23)
expression_3 = Expression(d=num_kg_m3, v=num_m3, dist=num_km, Expression="d*v*dist")
euro_kg_km = Panel("5")
ma_2 = MassAddition(Input=expression_3)  # -> Result, PartialResults
multiplication_10 = Multiplication(A=euro_kg_km, B=ma_2.Result)
total_shipping_cost = Panel(multiplication_10)

# ----
item_24 = ListItem(List=box_cluster_boxes_3, Index=int_selected_ids, Wrap=True)
preview_11 = CustomPreview(Geometry=item_24, Material=ColourSwatch(SwatchColor=RGB(42, 255, 0)))

# ---- group: Core Workflow
wbfacepolys = WeaverbirdsFacePolylines(Mesh=cluster_3)  # -> flatten(Polygons)
mergevox = MergeVoxel(Voxels=cluster_3)

dam_3 = DataDam(DataA=mergevox, BufferDelay=10000000, BufferMode=0)
objfromgroup = GetObjectsInGroup()

values_10 = ValueListener(Elements=button, SomeProperty=True)  # -> Values, Indices
setobj_2 = SetObjectValue(ObjectToSet=objfromgroup, ValueToSet=values_10.Values)
detect = StateDetection(Value=values_10.Values, Modulo=2)  # -> CurrentState, Counter
log_3 = DataLog(IncomingData=detect.CurrentState, ResetLog=values_10.Values, StartRecording=True, WrapValues=False, RecordingLength=2)
item_25 = ListItem(List=log_3, Index=0, Wrap=True)  # -> Item, Item1
bool_2 = Boolean(log_3)
and = GateAnd(A=item_25.Item, B=item_25.Item1)

gate_5 = StreamGate(Data=wbfacepolys, PassingSwitch=invert(values_10.Values))
preview_12 = CustomPreview(Geometry=gate_5, Material=ColourSwatch(SwatchColor=RGB(255, 255, 255)))

D = DateTime(Year=Slider(2020, range=0..10000), Month=Slider(12, range=0..100), Day=20, Hour=8, Minute=0, Second=0)
run = BooleanToggle(True)
L = Location(Latitude="41.3907372", Longitude="2.1745004")
times = DateTimes(DateTimeStart=637151040000000000, DateTimeEnd=D, MinuteInterval=Slider(10000, range=0..10000))
S = SolarAnalysisMeshFace(
    DateTime=times,
    Location=L,
    Mesh=mergevox,
    ONOFF=run,
    TimeZone="(UTC+01:00)Amsterdam,Brussels,Paris,Prague,Rome,Stockholm,Vienna")  # -> Mesh, Point, Hour, Minutes
gate_6 = StreamGate(Data=S.Mesh, PassingSwitch=invert(values_10.Values))
mcol = MeshColours(Mesh=gate_6, Colours=ColourSwatch(SwatchColor=RGB(232, 0, 77)))  # disabled

swatch_6 = ColourSwatch(SwatchColor=RGB(0, 255, 204))
gate_7 = StreamGate(PassingSwitch=invert(values_10.Values))
wbfacepolys_2 = WeaverbirdsFacePolylines(Mesh=gate_7)  # -> flatten(Polygons)
dash_3 = DashPattern(Curve=wbfacepolys_2, Pattern=Slider(0.2, range=0..1))  # -> Dashes, Gaps

save = DataStore(
    BooleanFlag=values_6.Values,
    Tag="Tag0",
    Data=mergevox,
    stored0_Key="Tag0",
    stored0_ghtree_Branch0_Path="{0}",
    stored0_ghtree_Branch0_Item0_TypeName="Grasshopper.Kernel.Types.GH_Mesh",
    stored1_Key="Tag6",
    stored1_ghtree_Branch0_Path="{0}",
    stored1_ghtree_Branch0_Item0_TypeName="Grasshopper.Kernel.Types.GH_Mesh",
    stored2_Key="Tag8",
    stored2_ghtree_Branch0_Path="{0}",
    stored2_ghtree_Branch0_Item0_TypeName="Grasshopper.Kernel.Types.GH_Mesh",
    stored3_Key="Tag10",
    stored3_ghtree_Branch0_Path="{0}",
    stored3_ghtree_Branch0_Item0_TypeName="Grasshopper.Kernel.Types.GH_Mesh")  # -> RetrievedData, Keys
wbfacepolys_3 = WeaverbirdsFacePolylines(Mesh=save.RetrievedData)
gate_8 = StreamGate(Stream=dam_3, Gate=values_7.Indices)  # -> Target0, Target1
demesh = DeconstructMesh(Mesh=S.Mesh)  # -> Vertices, Faces, Colours, Normals
mesh = Mesh(gate_6)  # disabled
previewlw_3 = CustomPreviewLineweights(Geometry=dash_3.Dashes, Shader=swatch_6, Absolute=False)
get_guidelines_from_mesh = GetGuidelinesFromMesh(M=gate_8.Target0, G=cluster_3)  # -> pl, pl_2

test_color = TestColor(BaseListOfColors=demesh.Colours, ColorToTestForInclusion=RGB(255, 0, 0), ColorThreshold=0.3)
panel_68 = Panel("0")
cull = CullPattern(List=demesh.Colours, CullPattern=test_color)
lng_5 = ListLength(List=demesh.Colours)
lng_6 = ListLength(List=cull)
division_5 = Division(A=lng_6, B=lng_5)
multiplication_11 = Multiplication(A=division_5, B=150)
gradient = Gradient(
    LowerLimit=panel_68,
    UpperLimit=Slider(70, range=0..100),
    Parameter=multiplication_11,
    stops=[0.15: RGB(130, 255, 205), 0.85: RGB(220, 0, 40)])

# ----
gradient_2 = Gradient(LowerLimit=0, UpperLimit=panel_68, Parameter=division_4, stops=[0.15: RGB(130, 255, 205), 0.85: RGB(220, 0, 40)])

chartappearance = ChartAppearance(ChartToModify=chart, Colors=gradient_2)

# ---- group: Core Workflow
test_color_2 = TestColor(BaseListOfColors=demesh.Colours, ColorToTestForInclusion=RGB(0, 34, 255), ColorThreshold=0.5)
cull_2 = CullPattern(List=demesh.Colours, CullPattern=test_color_2)
lng_7 = ListLength(List=demesh.Colours)
lng_8 = ListLength(List=cull_2)
division_6 = Division(A=lng_8, B=lng_7)
multiplication_12 = Multiplication(A=division_6, B=150)
subtraction_3 = Subtraction(A="100", B=multiplication_12)
gradient_3 = Gradient(
    LowerLimit="0",
    UpperLimit=Slider(70, range=0..100),
    Parameter=subtraction_3,
    stops=[0.15: RGB(130, 255, 205), 0.85: RGB(220, 0, 40)])

# ----
# Human UI
round_2 = Round(Number=multiplication_11)  # -> Nearest, Floor, Ceiling
round_3 = Round(Number=subtraction_3)  # -> Nearest, Floor, Ceiling
setchart_2 = SetChartContents(ChartToModify=chart_2, NewChartValues=round_2.Nearest)
setchart_3 = SetChartContents(ChartToModify=chart_3, NewChartValues=round_3.Nearest)
chartappearance_2 = ChartAppearance(ChartToModify=chart_2, Colors=gradient)
chartappearance_3 = ChartAppearance(ChartToModify=chart_3, Colors=gradient_3)

# ---- group: Core Workflow
clean_2 = CleanTree(RemoveNulls=True, RemoveInvalid=True, RemoveEmpty=False, Tree=get_guidelines_from_mesh.pl)
clean_3 = CleanTree(RemoveNulls=True, RemoveInvalid=True, RemoveEmpty=False, Tree=get_guidelines_from_mesh.pl_2)
dupln = RemoveDuplicateLines(Lines=clean_2, Tolerance=0.01)
dupln_2 = RemoveDuplicateLines(Lines=clean_3, Tolerance=0.01)
pt_9 = ConstructPoint(XCoordinate=0, YCoordinate=0, ZCoordinate=0)
pt_10 = ConstructPoint(XCoordinate=0, YCoordinate=0, ZCoordinate=Slider(10, range=0..10))
ln_7 = Line(StartPoint=pt_9, EndPoint=pt_10)
sortc = SortCurvesAlongCrv(Curves=dupln, GuideCrv=ln_7, CrvParam=0.5)  # -> SortedCurves, CurveIndex
sortc_2 = SortCurvesAlongCrv(Curves=dupln_2, GuideCrv=ln_7, CrvParam=0.5)  # -> SortedCurves, CurveIndex
len_2 = Length(Curve=sortc.SortedCurves)
len_3 = Length(Curve=sortc_2.SortedCurves)
weave = Weave(Pattern=[0, 1], Stream0=len_2, Stream1=len_3, NullGaps=False)
weave_2 = Weave(Pattern=[0, 1], Stream0=sortc.SortedCurves, Stream1=sortc_2.SortedCurves, NullGaps=False)

xz_5 = XZPlane(Origin=Point(0, 0, 0))
number_slider_38 = Slider(0.2, range=0..1)
rectangle_2 = Rectangle(Plane=xz_5, XSize=X_2, YSize=X_2, Radius=R)  # -> Rectangle, Length
ext = ExtendCurve(Curve=weave_2, Type=0, Start=number_slider_38, End=number_slider_38)
msweep = MeshSweep(RailCurve=ext, SectionCurve=rectangle_2.Rectangle, Accuracy=0.2, Cap=True, Autoorient=True, Rotation=0)
swatch_7 = ColourSwatch(SwatchColor=RGB(255, 0, 68))

# ---- group: Core Workflow / Material Fitting
button_11 = Button()
values_11 = ValueListener(Elements=button_4, SomeProperty=True)  # -> Values, Indices
lng_9 = ListLength(List=weave_2)
loop_start_2 = LoopStart(N=lng_9, T=values_11.Values, D0=len)  # -> port, Counter, Data, Data_2, Data_3, Data_4
item_26 = ListItem(List=weave, Index=loop_start_2.Counter, Wrap=True)
fsim_2 = FindSimilarMember(Data=item_26, Set=loop_start_2.Data)  # -> Hit, Index
cull_i_2 = CullIndex(List=loop_start_2.Data, Indices=fsim_2.Index, Wrap=True)
item_27 = ListItem(List=weave_2, Index=loop_start_2.Counter, Wrap=True)
running = Running(
    port=loop_start_2.port,
    Exit=False,
    Data=cull_i_2,
    Data_2=fsim_2.Index,
    Data_3=item_27,
    Data_4=loop_start_2.Counter,
    TimeOutVal=0,
    pausedState=False,
    state="Constant & Record")  # -> D0, flatten(D1), flatten(D2), flatten(D3)
subset_lengths = RemoteReceiver()
swatch_8 = ColourSwatch(SwatchColor=RGB(255, 0, 34))
item_28 = ListItem(List=branch_4, Index=running.D1, Wrap=True)
panel_69 = Panel("""90
0""")
lng_10 = ListLength(List=len)
preview_13 = CustomPreview(Geometry=item_28, Material=swatch_8)
center_12 = Center(Geometry=item_28)  # -> Center, Dimension
center_13 = Center(Geometry=running.D2)  # -> Center, Dimension
avr_8 = Average(Input=weave)
avr_9 = Average(Input=len)
repeat = RepeatData(Data=panel_69, Length=lng_10)
subtraction_4 = Subtraction(A=avr_8, B=avr_9)
item_29 = ListItem(List=repeat, Index=running.D3, Wrap=True)
ln_8 = Line(StartPoint=center_12.Center, EndPoint=center_13.Center)
rotate_7 = Rotate(Geometry=item_28, Angle=degrees(item_29), Plane=center_12.Center)  # -> Geometry, Transform
dash_4 = DashPattern(Curve=ln_8, Pattern=Slider(0.3, range=0..1))  # -> Dashes, Gaps
previewlw_4 = CustomPreviewLineweights(Geometry=dash_4.Dashes, Shader=swatch_8, Thickness=Slider(0.1, range=0..0.1), Absolute=False)
box_corners_3 = BoxCorners(Box=rotate_7.Geometry)  # -> CornerA, CornerB, CornerC, CornerD, CornerE, CornerF, CornerG, CornerH
move2pt = MoveToPoint(Geometry=rotate_7.Geometry, PointA=center_12.Center, PointB=center_13.Center)  # -> Moved, Vector, Transform
dist_4 = Distance(PointA=box_corners_3.CornerA, PointB=box_corners_3.CornerD)
end = EndPoints(Curve=running.D2)  # -> Start, End
dist_5 = Distance(PointA=end.Start, PointB=end.End)
values_12 = ValueListener(Elements=toggle_5, SomeProperty=True)  # -> Values, Indices
subtraction_5 = Subtraction(A=dist_4, B=dist_5)
gate_9 = StreamGate(Data=move2pt.Moved, PassingSwitch=values_12.Values)
abs = Absolute(Value=subtraction_5)
bnd_5 = Bounds(Numbers=abs)
dedomain_7 = DeconstructDomain(Domain=bnd_5)  # -> Start, End
gradient_4 = Gradient(
    LowerLimit=dedomain_7.End,
    UpperLimit=dedomain_7.Start,
    Parameter=abs,
    stops=[0.15: RGB(255, 130, 160), 0.85: RGB(220, 0, 40)])
wbfacepolys_4 = WeaverbirdsFacePolylines(Mesh=gate_9)
preview_14 = CustomPreview(Geometry=gate_9, Material=gradient_4)
previewlw_5 = CustomPreviewLineweights(Geometry=wbfacepolys_4, Shader=ColourSwatch(SwatchColor=RGB(255, 255, 255)), Absolute=False)

# ---- group: Core Workflow
msh2psrf = MeshToPolysurface(Mesh=gate_8.Target1, Triangles=invert(False), FaceMerge=invert(False))
bricks = Bricks(BondType=0, BrickDescription="215,102.5,65,10", Surface=msh2psrf, baseoff=0)  # -> Bricks, BondJoints, Dimensions
deplane = DeconstructPlane(Plane=bricks.Bricks)  # -> Origin, XAxis, YAxis, ZAxis
pl = PlaneNormal(Origin=deplane.Origin, ZAxis=deplane.ZAxis)
amp = Amplitude(Vector=pl, Amplitude=Slider(0.2, range=-0.5..0.5))
extrudem = ExtrudeAsMesh(Polyline=bricks.Bricks, Direction=amp, Cap=invert(False))

gate_10 = StreamGate(Data=extrudem, PassingSwitch=values_10.Values)
len_4 = Length(Curve=weave_2)
ma_3 = MassAddition(Input=len_4)  # -> Result, PartialResults
data_2 = Data(weave)
mcol_2 = MeshColours(Mesh=gate_10, Colours=ColourSwatch(SwatchColor=RGB(255, 0, 68)))
gate_11 = StreamGate(Data=msweep, PassingSwitch=values_10.Values)
gate_12 = StreamGate(Data=msweep, PassingSwitch=values_10.Values)
mcol_3 = MeshColours(Mesh=gate_12, Colours=swatch_7)
volume_4 = Volume(Geometry=gate_12)  # -> Volume, Centroid
mshedge = MeshEdgesWithTolerance(Mesh=gate_11, AngleThreshold="90")  # -> flatten(InteriorEdges), NakedEdges
ma_4 = MassAddition(Input=volume_4.Volume)  # -> Result, PartialResults
panel_70 = Panel(ma_4.Result)
previewlw_6 = CustomPreviewLineweights(Geometry=mshedge.InteriorEdges, Shader=ColourSwatch(SwatchColor=RGB(255, 255, 255)), Absolute=False)

mshedge_2 = MeshEdgesWithTolerance(Mesh=gate_10, AngleThreshold=Slider(90, range=0..100))  # -> flatten(InteriorEdges), NakedEdges

gate_13 = StreamGate(Data=mshedge_2.InteriorEdges, PassingSwitch=values_10.Values)

previewlw_7 = CustomPreviewLineweights(Geometry=gate_13, Shader=ColourSwatch(SwatchColor=RGB(255, 252, 252)), Thickness=Slider(0.1, range=0..1), Absolute=False)

# ==== cluster GetGuidelinesFromMesh
G = ClusterInput()
center = Center(Geometry=G)  # -> Center, Dimension
vec = VectorXYZ(XComponent=0, YComponent=Slider(3, range=0..10), ZComponent=0)  # -> Vector, Length
number_slider = Slider(0.124, range=0..1)
move = Move(Geometry=center.Center, Motion=vec.Vector)  # -> Geometry, Transform
number_slider_2 = Slider(3, range=0..10)
number_slider_3 = Slider(3, range=0..10)
vec_2 = VectorXYZ(XComponent=Slider(3, range=0..10), YComponent=0, ZComponent=0)  # -> Vector, Length
ln = Line(StartPoint=center.Center, EndPoint=move.Geometry)
vec_3 = VectorXYZ(XComponent=0, YComponent=0, ZComponent=number_slider)  # -> Vector, Length
vec_4 = VectorXYZ(XComponent=0, YComponent=0, ZComponent=number_slider)  # -> Vector, Length
M = ClusterInput()
move_2 = Move(Geometry=center.Center, Motion=vec_2.Vector)  # -> Geometry, Transform
ext = ExtendCurve(Curve=ln, Type=0, Start=number_slider_3, End=number_slider_2)
mcx = MeshCurve(Mesh=M, Curve=ext)  # -> Points, Faces
move_3 = Move(Geometry=center.Center, Motion=vec_3.Vector)  # -> Geometry, Transform
move_4 = Move(Geometry=move_2.Geometry, Motion=vec_4.Vector)  # -> Geometry, Transform
ln_2 = Line(StartPoint=move_3.Geometry, EndPoint=move_4.Geometry)
item = ListItem(List=mcx.Points, Index=0, Wrap=True)  # -> Item, Item1, Item2
ext_2 = ExtendCurve(Curve=ln_2, Type=0, Start=number_slider_3, End=number_slider_2)
mcx_2 = MeshCurve(Mesh=M, Curve=ext_2)  # -> Points, Faces
merge = Merge(Data1=item.Item, Data2=item.Item1)
pline = PolyLine(Vertices=merge, Closed=False)  # -> flatten(Polyline)
pl = ClusterOutput(pline)
item_2 = ListItem(List=mcx_2.Points, Index=0, Wrap=True)  # -> Item, Item1, Item2
merge_2 = Merge(Data1=item_2.Item, Data2=item_2.Item1)
pline_2 = PolyLine(Vertices=merge_2, Closed=False)  # -> flatten(Polyline)
pl_2 = ClusterOutput(pline_2)

# ==== cluster Cluster

number_slider = Slider(0.3, range=0..5)
number_slider_2 = Slider(10, range=0..10)
separator = CreateSeparator(Thickness=number_slider, Horizontal=True, Color=RGB(255, 0, 51), Height=number_slider_2)
separator_2 = CreateSeparator(Thickness=number_slider, Horizontal=True, Color=RGB(255, 0, 51), Height=number_slider_2)
separator_3 = CreateSeparator(Thickness=number_slider, Horizontal=True, Color=RGB(255, 0, 51), Height=number_slider_2)
separator_4 = CreateSeparator(Thickness=number_slider, Horizontal=True, Color=RGB(255, 0, 51), Height=number_slider_2)
separator_5 = CreateSeparator(Thickness=number_slider, Horizontal=True, Color=RGB(255, 0, 51), Height=Slider(20, range=0..100))
separator_6 = CreateSeparator(Thickness=Slider(0.01, range=0..0.01), Horizontal=True, Color=RGB(255, 0, 51), Height=Slider(160, range=0..1000))

S = ClusterOutput(separator)
S_2 = ClusterOutput(separator_2)
S_3 = ClusterOutput(separator_3)
S_4 = ClusterOutput(separator_4)
S_5 = ClusterOutput(separator_5)
S_6 = ClusterOutput(separator_6)

# ==== cluster Cluster_4
button = Button()
T = ClusterInput()
d0 = ClusterInput()
loop_start = LoopStart(Repeat=Slider(1, range=0..10), Trigger=T, Data=d0)  # -> port, Counter, flatten(Data)
panel = Panel("""0.25
0.125""")
B = ClusterInput()
item = ListItem(List=panel, Index=loop_start.Counter, Wrap=True)
cluster = Cluster_2(G=d0, B=B)
V = ClusterInput()
pline = PolyLine(Vertices=V, Closed=False)
item_2 = ListItem(List=cluster, Index=loop_start.Counter, Wrap=True)
divide = DivideCurve(Curve=pline, Count=10, Kinks=False)  # -> Points, Tangents, Parameters
division = Division(A=item_2, B=10)
voxgeom = VoxelizeGeometry(Geometry=loop_start.Data, Size=item)  # -> flatten(Mesh)
center = Center(Geometry=voxgeom)  # -> Center, Dimension
cluster_2 = Cluster_3(P=divide.Points, C=center.Center, N=division)
voxnbrs = VoxelNeighbours(Voxels=voxgeom, Index=cluster_2)  # -> Right, Left, Up, Down, Top, Bottom
entwine = Entwine(
    Branch00=voxnbrs.Right,
    Branch01=voxnbrs.Left,
    Branch02=voxnbrs.Up,
    Branch03=voxnbrs.Down,
    Branch04=voxnbrs.Top,
    Branch05=voxnbrs.Bottom,
    FlattenInputs=True)
tstat = TreeStatistics(Tree=entwine)  # -> Paths, Length, Count
i = ClusterInput()
item_3 = ListItem(List=tstat.Paths, Index=i, Wrap="True")
branch = TreeBranch(Tree=entwine, Path=item_3, MaintainPaths=True)  # -> flatten(Branch)
clean = CleanTree(RemoveNulls=True, RemoveInvalid=True, RemoveEmpty=False, Tree=branch)
cull_i = CullIndex(List=voxgeom, Indices=clean, Wrap=True)
voxgeom_2 = VoxelizeGeometry(Geometry=cull_i, Size=Slider(0.25, range=0..1))  # -> flatten(Mesh)
loop_end = LoopEnd(port=loop_start.port, Exit=False, Data=flatten(voxgeom_2), TimeOutVal=0, pausedState=False, state="Constant output")
item_4 = ListItem(List=cull_i, Index=Slider(409, range=0..1000), Wrap=True)
M = ClusterOutput(voxgeom_2)

# ==== cluster Cluster_5
col = ClusterInput()
col_2 = Colour(col)
separator = CreateSeparator(Thickness=0.5, Horizontal=True, Color=col_2, Height=Slider(20, range=0..100))
separator_2 = CreateSeparator(Thickness=0.5, Horizontal=True, Color=col_2, Height=Slider(20, range=0..100))
separator_3 = CreateSeparator(Thickness=0.5, Horizontal=True, Color=col_2, Height=Slider(20, range=0..100))
separator_4 = CreateSeparator(Thickness=0.5, Horizontal=True, Color=col_2, Height=Slider(20, range=0..100))
S = ClusterOutput(separator)
S_2 = ClusterOutput(separator_2)
S_3 = ClusterOutput(separator_3)
S_4 = ClusterOutput(separator_4)

# ==== cluster Cluster_2
G = ClusterInput()
area = Area(Geometry=G)  # -> Area, Centroid
B = ClusterInput()
division = Division(A=area.Area, B=B)
merge = Merge(Data1=division, Data2=area.Area)
R = ClusterOutput(merge)

# ==== cluster Cluster_3
P = ClusterInput()
C = ClusterInput()
N = ClusterInput()
cps = ClosestPoints(Point=P, Cloud=C, Count=N)  # -> ClosestPoint, flatten(CPIndex), Distance
num2pt = NumbersToPoints(Numbers=cps.CPIndex, Mask=1)
cullpt = CullDuplicates(Points=num2pt, Tolerance=0.1, CullMode=3)  # -> Points, Indices, Valence
pt2num = PointsToNumbers(Points=cullpt.Points, Mask=1)
N_2 = ClusterOutput(pt2num)
